# Grasshopper definition 230904ace405_analysis_script.gh (Grasshopper 1.0.7)
# plug-ins: LadybugGrasshopper, Human

pt = ConstructPoint(XCoordinate=Slider(10, range=0..50), YCoordinate=Slider(30, range=0..50), ZCoordinate=Slider(6, range=0..50))
pt_2 = ConstructPoint(XCoordinate=Slider(35, range=0..50), YCoordinate=Slider(30, range=0..50), ZCoordinate=Slider(9, range=0..50))
pt_3 = ConstructPoint(XCoordinate=Slider(0, range=0..50), YCoordinate=Slider(5, range=0..50), ZCoordinate=Slider(0, range=0..50))
pt_4 = ConstructPoint(XCoordinate=Slider(25, range=0..50), YCoordinate=Slider(10, range=0..50), ZCoordinate=Slider(21, range=0..50))
pt_5 = ConstructPoint(XCoordinate=Slider(10, range=0..50), YCoordinate=Slider(15, range=0..50), ZCoordinate=Slider(0, range=0..50))
pt_6 = ConstructPoint(XCoordinate=Slider(30, range=0..50), YCoordinate=Slider(45, range=0..50), ZCoordinate=Slider(9, range=0..50))
pt_7 = ConstructPoint(XCoordinate=Slider(15, range=0..50), YCoordinate=Slider(0, range=0..50), ZCoordinate=Slider(0, range=0..50))
pt_8 = ConstructPoint(XCoordinate=Slider(0, range=0..50), YCoordinate=Slider(35, range=0..50), ZCoordinate=Slider(0, range=0..50))
box = Box2Pt(PointA=pt_3, PointB=pt, Plane=PlaneXY(0, 0, 0))
box_2 = Box2Pt(PointA=pt_5, PointB=pt_2, Plane=PlaneXY(0, 0, 0))
box_3 = Box2Pt(PointA=pt_7, PointB=pt_4, Plane=PlaneXY(0, 0, 0))
box_4 = Box2Pt(PointA=pt_8, PointB=pt_6, Plane=PlaneXY(0, 0, 0))
brep = Brep(box_3)
brep_2 = Brep(box)
brep_3 = Brep(box_4)
brep_4 = Brep(box_2)
debrep = DeconstructBrep(Brep=brep_2)  # -> Faces, Edges, Vertices
debrep_2 = DeconstructBrep(Brep=brep_4)  # -> Faces, Edges, Vertices
item = ListItem(List=debrep.Faces, Index=0, Wrap=True)
item_2 = ListItem(List=debrep.Faces, Index=Slider(2, range=0..5), Wrap=True)
item_3 = ListItem(List=debrep.Faces, Index=Slider(5, range=0..5), Wrap=True)
item_4 = ListItem(List=debrep_2.Faces, Index=Slider(2, range=0..5), Wrap=True)
item_5 = ListItem(List=debrep_2.Faces, Index=Slider(5, range=0..5), Wrap=True)
cluster = Cluster(
    brep=item,
    X=Slider(0.3, range=0..1),
    Y=Slider(0.3, range=0..1),
    X_2=Slider(0.7, range=0..1),
    Y_2=Slider(0.7, range=0..1))
cluster_2 = Cluster(
    brep=item_2,
    X=Slider(0.23, range=0..1),
    Y=Slider(0.25, range=0..1),
    X_2=Slider(0.58, range=0..1),
    Y_2=Slider(0.8, range=0..1))
cluster_3 = Cluster(
    brep=item_3,
    X=Slider(0.15, range=0..1),
    Y=graft([Slider(0.15, range=0..1), Slider(0.62, range=0..1)]),
    X_2=Slider(0.8, range=0..1),
    Y_2=graft([Slider(0.26, range=0..1), Slider(0.73, range=0..1)]))  # -> flatten(S)
cluster_4 = Cluster(
    brep=item_4,
    X=graft([Slider(0.23, range=0..1), Slider(0.7, range=0..1)]),
    Y=Slider(0.25, range=0..1),
    X_2=graft([Slider(0.5, range=0..1), Slider(0.88, range=0..1)]),
    Y_2=Slider(0.8, range=0..1))  # -> flatten(S)
cluster_5 = Cluster(
    brep=item_5,
    X=Slider(0.14, range=0..1),
    Y=Slider(0.07, range=0..1),
    X_2=Slider(0.7, range=0..1),
    Y_2=Slider(0.29, range=0..1))
brep_5 = Brep(cluster)
brep_6 = Brep(cluster_2)
brep_7 = Brep(cluster_4)
brep_8 = Brep(cluster_3)
brep_9 = Brep(cluster_5)

# ---- group: Context
brep_10 = Brep(box_3)
brep_11 = Brep(box_4)

# ---- group: Rooms
brep_12 = Brep(box_2)
brep_13 = Brep(box)

# ---- group: Windows
brep_14 = Brep(brep_5)
brep_15 = Brep(brep_7)
brep_16 = Brep(brep_6)

# ---- group: Skylights
brep_17 = Brep(brep_8)
brep_18 = Brep(brep_9)

# ----
geo = Geometry(flatten([brep_11, brep_10]))
geo_2 = Geometry(flatten([brep_14, brep_16, brep_15]))
geo_3 = Geometry(flatten([brep_17, brep_18]))

# ---- group: Select program
# Define program and construction
bldgprograms = HBBuildingPrograms({"LargeOffice", "MediumOffice", "SmallOffice", "MidriseApartment", "HighriseApartment", "Retail", "StripMall", "PrimarySchool", "SecondarySchool", "SmallHotel", "LargeHotel", "Hospital", "Outpatient", "Laboratory", "Warehouse", "SuperMarket", "FullServiceRestaurant", "QuickServiceRestaurant", "Courthouse", "LargeDataCenterHighITE", "LargeDataCenterLowITE", "SmallDataCenterHighITE", "SmallDataCenterLowITE"}, selected="MidriseApartment")
# # Define program and construction
# To be added...
# 
# ## Instructions
# To be added...
# 
# ## Inputs
# - ...
# 
# ## Outputs
# - ...
# 
# ## Interpretation
# To be added...
searchprog = HBSearchPrograms(bldg_prog=bldgprograms)  # -> room_prog; plug-in component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
list = ItemSelector(
    searchprog,
    {"2019::MidriseApartment::Apartment", "2019::MidriseApartment::Corridor", "2019::MidriseApartment::Office"}, selected="2019::MidriseApartment::Apartment")

# ---- group: Select construction set
bldgvintages = HBBuildingVintages({"ASHRAE 90.1 2019  |  IECC 2021": "2019", "ASHRAE 90.1 2016  |  IECC 2018": "2016", "ASHRAE 90.1 2013  |  IECC 2015": "2013", "ASHRAE 90.1 2010  |  IECC 2012": "2010", "ASHRAE 90.1 2007  |  IECC 2009": "2007", "ASHRAE 90.1 2004  |  IECC 2006": "2004", "1980-2004 (CBECS)": "1980_2004", "Pre-1980 (CBECS)": "pre_1980"}, selected="ASHRAE 90.1 2019  |  IECC 2021")
constructiontypes = HBConstructionTypes({"SteelFramed", "WoodFramed", "Mass", "Metal Building"}, selected="WoodFramed")
climatezones = HBClimateZones({"1 - Very Hot": "1", "2 - Hot": "2", "3 - Warm": "3", "4 - Mixed": "4", "5 - Cool": "5", "6 - Cold": "6", "7 - Very Cold": "7", "8 - Subarctic": "8"}, selected="6 - Cold")
constrsetclimate = HBConstructionSetByClimate(climate_zone=climatezones, vintage=bldgvintages, constr_type=constructiontypes)  # -> constr_set; plug-in component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
panel = Panel(constrsetclimate)

# ---- group: Modify program
# Assemble Honeybee model
applyloadvals = HBApplyLoadValues(room_or_program=flatten(list))  # -> report, mod_obj; plug-in component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

# ----
panel_2 = Panel("https://energyplus-weather.s3.amazonaws.com/europe_wmo_region_6/SWE/SWE_Goteborg.Landvetter.025260_IWEC/SWE_Goteborg.Landvetter.025260_IWEC.zip")
# Get climate data
button = Button()
# Toggle this to enable analysis
number_slider = Slider(0.3, range=0..1)
simpar = HBSimulationParameter(timestep=6)  # -> sim_par; plug-in component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
epwmap = LBEPWmap(epw_map=button)  # -> report; plug-in component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
# # Assemble Honeybee model
# This cluster takes input geometry and geometric information and generates a valid Honeybee model which can be used in the following analysis steps.
# 
# ## Instructions
# Enter the relevant inputs to generate the Honeybee model. Windows can either be created using an input geometry or through auto-generation using a window-to-wall ratio.
# 
# ### Room geometry
# Each 3D Brep entered represents one room or thermal zone in the building with no air exchange between them. The Breps should be closed and 3D to generate valid rooms. The room geometries should represent the inner boundary of the external walls
# 
# ### Windows/apertures
# Windows can either be defined through a list of 2D surfaces which intersect with the room 3D geometries, or be auto-generated through the list of numeric outputs.
# 
# ### Wall/roof thicknesses
# Wall and roof thicknesses are supplied to generate a shading geometry representing the external surface thickness
# 
# ### Louvers
# If all related inputs are entered, shading louvers will be generated on each window according to the entered parameters.
# 
# ### Different directions
# All the above inputs will be the same for all rooms, however they can be optionally entered as a list which represents different values for different cardinal directions, in the order (N, E, S, W).
# 
# ## Inputs
# - `Model name` - text string representing the name of the analysis model
# - `Room geometry` - list of 3D closed Brep geometries representing each room/zone in the model
# - `Construction set` - text string representing the construction to be used for the rooms, can be retrieved using the HB Construction Set by Climate component
# - `Program` - Honeybee Program or list of which are applied to the rooms in the model. Can be defined using the HB Search Programs component
# - `Context geometry` - list of surrounding Brep geometries which shades the analysed Rooms
# - `Windows` - list of 2D Brep geometries which represent the openings in the building envelope. If not supplied, windows are instead generated through definition of window-to-wall ratios as defined below
# - `Skylights` - list of 2D Brep geometries which represent the openings in the building roof
# - `Window-to-wall ratio` - number representing the window-to-wall ratio on each exterior surface Used if no window geometries are supplied.
# - `Subdivide generated windows` - set to True if the window surface area should be divided into multiple windows on each exterior surface
# - `Window height` - number representing the target height of the auto-generated windows
# - `Sill height` - number representing how high the lower edge of the auto-generated windows should be from the room floor
# - `Horizontal separation` - number representing how far separated the auto-generated windows should be horizontally
# - `Vertical separation` - number representing if auto-generated windows should be split vertically and if so, what distance
# - `Wall thickness` - number representing the thickness of the exterior walls, used to generate shading geometry for windows
# - `Roof thickness` - number representing the thickness of the roof, used to generate shading geometry for skylights
# - `Louver depth` - number optionally representing the depth of louvers
# - `Number of louvers` - number optionally representing the amount of louvers on each window
# - `Distance between louvers ` - number optionally representing the distance between louvers on each window
# - `Louver angle` - number optionally representing if louvers should be tilted
# - `Vertical/horizontal louvers` - boolean, set to True if louvers should be vertical
# 
# ## Outputs
# - `Honeybee model` - valid Honeybee model for further analysis
# 
# ## Interpretation
# To be added...
falsestart = LBFalseStartToggle(False)
geo_4 = Geometry(geo_3)
geo_5 = Geometry(geo_2)
geo_6 = Geometry(geo)
data = Data(applyloadvals.mod_obj)
data_2 = Data(panel)
geo_7 = Geometry([brep_13, brep_12])
modeltoosm = HBModelToOSM()  # -> report, jsons, osw, osm, idf, sql, zsz, rdd, html; plug-in component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
create_honeybee_model = CreateHoneybeeModel(
    model_name=" my model",
    room_geometry=geo_7,
    construction_set=data_2,
    program=data,
    context_geometry=geo_6,
    windows=geo_5,
    skylights=geo_4,
    wall_thickness=Slider(0.3, range=0..1),
    roof_thickness=number_slider)
filter = StreamFilter(Gate=falsestart, Stream1=create_honeybee_model)
vizbytype = HBVisualizeByType(hb_objs=create_honeybee_model)  # -> walls, interior_walls, roofs, ceilings, exterior_floors, interior_floors, air_walls, apertures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; plug-in component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
deconstructmodel = HBDeconstructModel(model=filter)  # -> rooms, faces, apertures, doors, shades; plug-in component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
vizbybc = HBVisualizeByBC(hb_objs=create_honeybee_model)  # -> outdoors, surface, ground, adiabatic, other, wire_frame; plug-in component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
data_3 = Data(filter)
# Daylight Glare Probability (DGP)
panel_3 = Panel("Perspective")
roomenergyattr = HBRoomEnergyAttributes({"Program": "properties.energy.program_type.display_name", "Construction Set": "properties.energy.construction_set.display_name", "Is Conditioned": "properties.energy.is_conditioned", "People per Area [ppl/m2]": "properties.energy.people.people_per_area", "Area per Person [m2/ppl]": "properties.energy.people.area_per_person", "Lighting per Area [W/m2]": "properties.energy.lighting.watts_per_area"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}, selected="Program")
faceenergyattr = HBFaceEnergyAttributes({"Construction": "properties.energy.construction.display_name", "Materials": "properties.energy.construction.layers", "Thickness [m]": "properties.energy.construction.thickness", "Density [kg/m2]": "properties.energy.construction.mass_area_density", "Heat Capacity [J/K-m2]": "properties.energy.construction.area_heat_capacity", "Construction R-Value [m2-K/W]": "properties.energy.construction.r_value", "Construction U-Value [W/m2-K]": "properties.energy.construction.u_value", "Construction U-Factor [W/m2-K]": "properties.energy.construction.u_factor", "Construction SHGC [Unshaded]": "properties.energy.construction.shgc", "R-Factor [m2-K/W]": "properties.energy.r_factor", "U-Factor [W/m2-K]": "properties.energy.u_factor", "SHGC [Unshaded]": "properties.energy.shgc", "Solar Transmitance [Unshaded]": "properties.energy.construction.solar_transmittance", "Visible Transmitance [Unshaded]": "properties.energy.construction.visible_transmittance", "Solar Reflectance [Outside]": "properties.energy.construction.outside_solar_reflectance", "Solar Reflectance [Inside]": "properties.energy.construction.inside_solar_reflectance", "Fraction Area Operable": "properties.energy.vent_opening.fraction_area_operable", "Fraction Height Operable": "properties.energy.vent_opening.fraction_height_operable", "Discharge Coefficient": "properties.energy.vent_opening.discharge_coefficient"}, selected="Thickness [m]")
# Daylight (Illuminance, DA and UDI)
number_slider_2 = Slider(6, range=1..12)
faceattr = HBFaceAttributes({"Display Name": "display_name", "Simulation Name (Identifier)": "identifier", "Boundary Condition": "boundary_condition", "Has Parent": "has_parent", "Parent": "parent", "Azimuth": "azimuth", "Altitude": "altitude", "Area": "area", "Perimeter": "perimeter", "Face Type": "type", "Aperture Is Operable": "is_operable", "Door Is Glass": "is_glass"}, selected="Azimuth")
# Weather visualisation
pt_9 = ConstructPoint(XCoordinate=Slider(21, range=0..100), YCoordinate=Slider(15, range=0..100), ZCoordinate=0)
# Visualise properties
roomattr = HBRoomAttributes({"Display Name": "display_name", "Simulation Name (Identifier)": "identifier", "Multiplier": "multiplier", "Floor Area Excluded": "exclude_floor_area", "Story": "story", "Volume": "volume", "Gross Floor Area": "floor_area", "Exposed Area": "exposed_area", "Exterior Wall Area": "exterior_wall_area", "Exterior Aperture Area": "exterior_aperture_area", "Average Floor Elevation": "average_floor_height"}, selected="Exterior Aperture Area")
# # Visualise properties
# This cluster visualises room and face attributes of a Honeybee model
# 
# ## Instructions
# Input the Honeybee model to be visualised and select room/face attributes using the HB Room Attributes/HB Room Energy Attibrutes/HB Face Attributes/HB Face Energy Attributes dropdown components. Adjust precision of the attributes using the `Number of decimals` inputs
# 
# ## Inputs
# - `Honeybee model` - Honeybee model to be visualised
# - `Room attribute` - Honeybee Room  or Room Energy attribute to visualise
# - `Number of decimals (room)` - Precision of room attribute output
# - `Face attribute` - Honeybee Face  or Face Energy attribute to visualise
# - `Number of decimals (face)` - Precision of face attribute output
# 
# ## Outputs
# - `Visualised room attributes` - mesh representing the selected room attribute
# - `Visualised face attributes` - mesh representing the selected face attribute
# 
# ## Interpretation
# To be added...
number_slider_3 = Slider(4, range=0..10)
falsestart_2 = LBFalseStartToggle(False)
# # Daylight (Illuminance, DA and UDI)
# This cluster simulates illuminance for a specified hour of the year and daylight autonomy (DA) and useful daylight illuminance (UDI) for the entire year across an analysis surface.
# 
# ## Instructions
# Enter all inputs and set `Run Illuminance` or `Run Annual Daylight Simulation`to True to investigate daylight. The illuminance study covers a specified time step whereas the annual daylight simulation covers the full year. The `grid size` and `detail level` inputs can be used to improve the fidelity of the simulation at the cost of simulation time. The study can take several minutes, depending on the grid size and detail level.
# 
# ## Inputs
# - `EPW file URL` - the URL for a EPW file which describes the location
# - `Honeybee model` - the Honeybee model for analysis
# - `Grid size` - the resolution of the analysis grid in metres
# - `Detail level (0-2)` - level of detail for the daylight simulation, the higher value, the higher detail and the slower the simulation
# - `Month (illuminance)` - month of the analysis period  for the illuminance simulation (1-12)
# - `Day (illuminance)` - date of the analysis period for the illuminance simulation (1-31)
# - `Hour (illuminance)` - hour of the analysis period for the illuminance simulation (0-23)
# - `Run Illuminance` - set to True to run the illuminance analysis for the specified timestep
# - `Run Annual Daylight Simulation` - set to True to run the full year daylight simulation
# 
# ## Outputs
# - `Illuminance [Lux]` - a mesh visualising the amount of incident radiation which hits the analysis surface at the specified timestep
# - `Spatial Daylight Autonomy [-]` - the mean SDA for the entire analysis surface
# - `Daylight autonomy [%]` - a mesh visualising the value of DA across the analysis surface
# - `UDI [%]` - a mesh visualising the value of Useful Daylight Illuminance across the analysis surface
# - `UDI <50 [%]` - a mesh visualising the percentage of time that the lower treshold of illuminance is not achieved across the analysis surface
# - `UDI >3000 [%]` - a mesh visualising the percentage of time that the upper treshold of illuminance is exceeded across the analysis surface
# 
# ## Interpretation
# To be added...
falsestart_3 = LBFalseStartToggle(False)
# # Daylight Glare Probability
# This cluster calculates the DGP for a specific view.
# 
# ## Instructions
# Enter all inputs and set `Run Glare analysis`to True to investigate glare potential for the set viewport and time. For a simple model this simulation takes around 50-60s.
# 
# ## Inputs
# - `EPW file URL` - the URL for a EPW file which describes the location
# - `Honeybee model` - the Honeybee model for analysis
# - `Viewport name` - the string name of a viewport in the Rhino model which shall be analysed
# - `Month` - month of the analysis period (1-12)
# - `Day` - date of the analysis period (1-31)
# - `Hour` - hour of the analysis period (0-23)
# - `Run Glare analysis` - set to True to run the analysis
# 
# ## Outputs
# - `Daylight glare probability (DGP)` - a value for the probability of glare occuring in this view at this time [%]
# - `HDR image` - a HDR image which can be visualised using LB ImageViewer to show what areas cause glare
# - `HDR false color image` - a HDR image with modified colors to more clearly see causes of glare
# 
# ## Interpretation
# To be added...
falsestart_4 = LBFalseStartToggle(False)
falsestart_5 = LBFalseStartToggle(False)
falsestart_6 = LBFalseStartToggle(False)
falsestart_7 = LBFalseStartToggle(False)
# Life cycle assessment (LCA)
# # Life Cycle Assessment (LCA)
# This cluster calculates the embodied carbon for the input Honeybee model
# 
# ## Instructions
# Enter the inputs to calculate the GWP (Global Warming Potential), i.e. the embodied carbon, for the materials in the Honeybee model
# 
# ## Inputs
# - `Honeybee model` - the Honeybee model for analysis
# 
# ## Outputs
# - `Total GWP` - total GWP for the modules A1-A5.1 [kg CO2eq]
# - `GWP by element type` - GWP of each element type for the modules A1-A5.1 [kg CO2eq]
# - `Element types` - list of element types in the model
# 
# ## Interpretation
# To be added...
data_4 = Data(filter)
falsestart_8 = LBFalseStartToggle(False)
# Simple energy simulations
falsestart_9 = LBFalseStartToggle(False)
honeybee_model = Data(filter)
falsestart_10 = LBFalseStartToggle(False)
data_5 = Data(panel_2)
data_6 = Data(data_3)
# # Weather visualisation
# This cluster visualises weather data from a .epw file including solar radiation and temperature, as applied to a target geometry
# 
# ## Instructions
# Enter all the inputs and visualise wind, sky view and temperature,  set `Run direct sun hours study` and `Run incident radiation study` to visualise solar radiation
# 
# ## Inputs
# - `EPW file URL` - the URL for a EPW file which describes the location
# - `Target Geometry` - geometry on which to apply irradiation study
# - `Context Geometry` - geometry which shades the target geometry
# - `Run direct sun hours study` - set to True to run the direct sun hours study
# - `Run incident radiation study` - set to True to run the incident radiation study
# - `Sky mask centre point` - point at which to generate sky mask
# 
# ## Outputs
# - `Sky dome` - mesh visualising the directions where solar radiation comes from during the year at the location
# - `Sky mask - mesh visualising what portions of the sky are visible at the specified point
# - `Wind rose` - mesh visualising wind directions and velocities during the year
# - `Dry bulb temperature line chart` - mesh visualising dry bulb temperature during the year
# - `Dry bulb temperature 2D chart` - mesh visualising dry bulb temperature for each hour of the year
# - `Direct sun hours` - mesh visualising the number of direct sun hours on the target geometry
# - `Incident radiation` - mesh visualising the incident radiation [kWh/m2] on the target geometry
# 
# ## Interpretation
# To be added...
pt_10 = Point(pt_9)
# # Detailed energy simulations
# This cluster simulates energy balance over a year and outputs the total energy use intensity (EUI), divided into end uses, and detailed graphs of the energy balance, peak cooling/heating, and cooling/heating load profiles
# 
# ## Instructions
# Enter all inputs and set `Run Energy Simulation` to true to run the energy simulation
# 
# ## Inputs
# - `EPW file URL` - the URL for a EPW file which describes the location
# - `Honeybee model` - the Honeybee model for analysis
# - `Run Energy Simulation` - set to True to run the energy simulation
# 
# ## Outputs
# - `Energy use intensity [kWh/m2a]` - A number representing the total energy use of the model
# - `Energy use intensity per end use [kWh/m2a]` - A list of values with the energy uses split into different end uses
# - `End uses` - A list of text strings representing the different end uses
# - `Annual hourly energy results` - various meshes representing different energy results over the hours of the year
# - `Monthly energy balance` - A monthly breakdown of the energy balance, with energy sources in the top and energy sinks in the bottom
# - `Peak cooling` - A number representing the peak cooling load in each zone
# - `Peak heating` - A number representing the peak heating load in each zone
# - `Cooling load profile` - A mesh representing the cooling load profile during the design day
# - `Heating load profile` - A mesh representing the heating load profile during the design day
# 
# ## Interpretation
# To be added...
data_7 = Data(filter)
txt = Text(panel_3)
data_8 = Data(filter)
# Detailed energy simulations
data_9 = Data(panel_2)
geo_8 = Geometry(geo_6)
# # Simple energy simulations
# Streamlined energy simulations which calculate energy balance across the year, and peak loads on the design day, for the input Honeybee rooms.
# 
# ## Instructions
# Enter all inputs and set `Run Energy Balance` or `Run Peak Loads`to True to investigate energy use for the specified Honeybee rooms considering the specified Honeybee shade objects. Adjust the y axis of output graphs using the `Graph max` input.
# 
# ## Inputs
# - `EPW file URL` - the URL for a EPW file which describes the location
# - `Honeybee rooms` - the Honeybee rooms which shall be analysed
# - `Shading objects` - Honeybee shade objects which block solar radiation toward the simulated rooms
# - `Run Energy Balance` - set to True to run the energy balance simulation
# - `Run Peak Loads` - set to True to run the peak loads simulation
# - `Graph max` - max value for the y axis of output graphs
# 
# ## Outputs
# - `Annual energy balance` - mesh visualising energy balance of each month of the year broken down into energy sources/sinks
# - `Daily cooling profile` - mesh visualising the cooling need during the design day (hottest day of the year)
# - `Daily heating profile` - mesh visualising the heating need during the design day (coldest day of the year)
# - `Cooling balance (design day)` - mesh visualising the cooling sources and sinks during the design day (hottest day of the year)
# - `Heating balance (design day)` - mesh visualising the heating sources and sinks during the design day (coldest day of the year)
# 
# ## Interpretation
# To be added...
data_10 = Data(deconstructmodel.shades)
data_11 = Data(panel_2)
geo_9 = Geometry(geo_7)
honeybee_rooms = Data(deconstructmodel.rooms)
data_12 = Data(panel_2)
data_13 = Data(panel_2)
cluster_6 = Cluster_4(honeybee_model=data_4)  # -> total_gwp_2, gwp_by_element_type_2, element_types_2
daylight_metrics = DaylightMetrics(
    epw_file_url=data_5,
    honeybee_model=honeybee_model,
    grid_size=Slider(1, range=0..10),
    detail_level_0_2=Slider(0, range=0..2),
    month_illuminance=number_slider_2,
    day_illuminance=Slider(21, range=1..31),
    hour_illuminance=Slider(12, range=0..23),
    run_illuminance=falsestart_3,
    run_annual_daylight_simulation=falsestart_2)  # -> illuminance_lux_2, spatial_daylight_autonomy_2, daylight_autonomy_2, udi_2, udi_50_2, udi_3000_2
visualise_properties = VisualiseProperties(
    honeybee_model=data_6,
    room_attribute=roomenergyattr,
    number_of_decimals_room=Slider(4, range=0..10),
    face_attribute=faceenergyattr,
    number_of_decimals_face=number_slider_3)  # -> visualised_room_attributes_2, visualised_face_attributes_2
detailed_energy_simulations = DetailedEnergySimulations(epw_file_url=data_9, honeybee_model=data_7, run_energy_simulation=falsestart_5)  # -> energy_use_intensity_2, energy_use_intensity_per_end_use_2, end_uses_2, annual_hourly_energy_results_2, monthly_energy_balance_2, peak_cooling_2, peak_heating_2, cooling_load_profile_2, heating_load_profile_2
glare = Glare(
    epw_file_url_2=data_11,
    epw_file_url=data_8,
    viewport_name=txt,
    month=Slider(6, range=1..12),
    day=Slider(21, range=1..31),
    hour=Slider(12, range=0..23),
    run_glare_analysis=falsestart_4)  # -> daylight_glare_probability_dgp_2, hdr_image_2, hdr_false_color_image_2
simple_energy_simulations = SimpleEnergySimulations(
    epw_file_url=data_13,
    honeybee_rooms=honeybee_rooms,
    shading_geometry=data_10,
    run_energy_balance=falsestart_9,
    run_peak_loads=falsestart_6,
    graph_max=Slider(15000, range=0..20000))  # -> annual_energy_balance_2, daily_cooling_profile_2, daily_heating_profile_2, cooling_balance_design_day_2, heating_balance_design_day_2
weather_visualisation = WeatherVisualisation(
    _1=data_12,
    run_weather_visualisation=falsestart_10,
    target_geometry_2=geo_9,
    target_geometry=geo_8,
    run_direct_sun_hours_study=falsestart_8,
    run_incident_radiation_study=falsestart_7,
    sky_mask_centre_point=pt_10)  # -> sky_dome, sky_mask, wind_rose, dry_bulb_temperature_line_chart, dry_bulb_temperature_2d_chart, direct_sun_hours_2, incident_radiation
data_14 = Data(cluster_6.total_gwp_2)
data_15 = Data(cluster_6.gwp_by_element_type_2)
data_16 = Data(cluster_6.element_types_2)
data_17 = Data(daylight_metrics.illuminance_lux_2)
data_18 = Data(daylight_metrics.spatial_daylight_autonomy_2)
data_19 = Data(simple_energy_simulations.annual_energy_balance_2)
data_20 = Data(daylight_metrics.daylight_autonomy_2)
data_21 = Data(daylight_metrics.udi_2)
data_22 = Data(simple_energy_simulations.daily_cooling_profile_2)
data_23 = Data(daylight_metrics.udi_50_2)
data_24 = Data(simple_energy_simulations.daily_heating_profile_2)
data_25 = Data(daylight_metrics.udi_3000_2)
data_26 = Data(simple_energy_simulations.cooling_balance_design_day_2)
data_27 = Data(simple_energy_simulations.heating_balance_design_day_2)
data_28 = Data(visualise_properties.visualised_face_attributes_2)
data_29 = Data(visualise_properties.visualised_room_attributes_2)
panel_4 = Panel(data_16)
data_30 = Data(weather_visualisation.sky_dome)
data_31 = Data(weather_visualisation.sky_mask)
data_32 = Data(detailed_energy_simulations.energy_use_intensity_2)
data_33 = Data(weather_visualisation.wind_rose)
data_34 = Data(detailed_energy_simulations.energy_use_intensity_per_end_use_2)
data_35 = Data(weather_visualisation.dry_bulb_temperature_line_chart)
data_36 = Data(weather_visualisation.dry_bulb_temperature_2d_chart)
data_37 = Data(detailed_energy_simulations.end_uses_2)
data_38 = Data(weather_visualisation.direct_sun_hours_2)
data_39 = Data(weather_visualisation.incident_radiation)
data_40 = Data(detailed_energy_simulations.annual_hourly_energy_results_2)
data_41 = Data(detailed_energy_simulations.monthly_energy_balance_2)
data_42 = Data(detailed_energy_simulations.peak_cooling_2)
data_43 = Data(detailed_energy_simulations.peak_heating_2)
data_44 = Data(detailed_energy_simulations.cooling_load_profile_2)
data_45 = Data(detailed_energy_simulations.heating_load_profile_2)
panel_5 = Panel(data_15)
num = Number(falsestart_4)
num_2 = Number(glare.daylight_glare_probability_dgp_2)
num_3 = Number(falsestart_4)
imageviewer = LBImageViewer(ImagePath_=glare.hdr_false_color_image_2, _scale_=num, DisableClickable=False, SaveImgWithCoords=False, scale=0.5)  # -> ImagePath, Values, GIF
imageviewer_2 = LBImageViewer(ImagePath_=glare.hdr_image_2, _scale_=num_3, DisableClickable=False, SaveImgWithCoords=False, scale=0.5)  # -> ImagePath, Values, GIF

# ==== cluster Cluster
brep = ClusterInput()
X = ClusterInput()
Y = ClusterInput()
X_2 = ClusterInput()
Y_2 = ClusterInput()
brep_2 = Brep(brep)
pt = ConstructPoint(XCoordinate=X, YCoordinate=Y, ZCoordinate=0)
pt_2 = ConstructPoint(XCoordinate=X_2, YCoordinate=Y_2, ZCoordinate=0)
evalsrf = EvaluateSurface(Surface=reparameterize(brep_2), Point=pt)  # -> Point, Normal, UDirection, VDirection, Frame
evalsrf_2 = EvaluateSurface(Surface=reparameterize(brep_2), Point=pt_2)  # -> Point, Normal, UDirection, VDirection, Frame
pdecon = Deconstruct(Point=[evalsrf.Point, evalsrf_2.Point])  # -> XComponent, YComponent, ZComponent
sort = SortList(Keys=pdecon.ZComponent, ValuesA=[evalsrf.Point, evalsrf_2.Point])  # -> Keys, ValuesA
pl = PlaneNormal(Origin=evalsrf.Point, ZAxis=evalsrf.Normal)
item = ListItem(List=sort.ValuesA, Index=0, Wrap=True)
item_2 = ListItem(List=sort.ValuesA, Index=Slider(1, range=0..1), Wrap=True)
rec_2pt = Rectangle2Pt(Plane=pl, PointA=item, PointB=item_2, Radius=0)  # -> Rectangle, Length
boundary = BoundarySurfaces(Edges=rec_2pt.Rectangle)
S = ClusterOutput(boundary)

# ==== cluster WeatherVisualisation
_1 = ClusterInput()
target_geometry = ClusterInput()
run_direct_sun_hours_study = ClusterInput()
sky_mask_centre_point = ClusterInput()
run_incident_radiation_study = ClusterInput()
run_weather_visualisation = ClusterInput()
target_geometry_2 = ClusterInput()
run_weather_visualisation_2 = Boolean(run_weather_visualisation)
filter = StreamFilter(Gate=run_weather_visualisation_2, Stream1=_1)
epw_file_url = Data(filter)

# ---- group: Get weather data
downloadepw = LBDownloadWeather(weather_URL=epw_file_url)  # -> epw_file, stat_file, ddy_file; plug-in component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
falsestart = LBFalseStartToggle(False)
epwtoddy = LBEPWToDDY(weather_file=downloadepw.epw_file, write=falsestart)  # -> ddy_file; plug-in component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
importloc = LBImportLocation(epw_file=downloadepw.epw_file)  # -> location; plug-in component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
importstat = LBImportSTAT(stat_file=downloadepw.stat_file)  # -> location, ashrae_zone, koppen_zone, clear_dir_norm_rad, clear_diff_horiz_rad, ann_heat_dday_996, ann_heat_dday_990, ann_cool_dday_004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; plug-in component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
constrloc = LBConstructLocation(elevation=0)  # -> location; plug-in component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
importepw = LBImportEPW(epw_file=downloadepw.epw_file)  # -> location, dry_bulb_temperature, dew_point_temperature, relative_humidity, wind_speed, wind_direction, direct_normal_rad, diffuse_horizontal_rad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; plug-in component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
importddy = LBImportDDY(ddy_file=downloadepw.ddy_file)  # -> location, design_days; plug-in component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

# ----
panel = Panel(importloc)

# ---- group: Wind rose
analysisperiod = LBAnalysisPeriod(
    start_month=Slider(1, range=1..12),
    start_day=Slider(1, range=1..31),
    start_hour=Slider(0, range=0..23),
    end_month=Slider(12, range=1..12),
    end_day=Slider(31, range=1..31),
    end_hour=Slider(23, range=0..23))  # -> period, hoys, dates; plug-in component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
windrose = LBWindRose(data=importepw.wind_speed, wind_direction=importepw.wind_direction, show_calm=Toggle(True), period=analysisperiod.period)  # -> report, mesh, compass, orient_line, freq_line, windrose_line, legend, title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; plug-in component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

# ---- group: Sun path
analysisperiod_2 = LBAnalysisPeriod(
    start_month=Slider(1, range=1..12),
    start_day=Slider(1, range=1..31),
    start_hour=Slider(0, range=0..23),
    end_month=Slider(12, range=1..12),
    end_day=Slider(31, range=1..31),
    end_hour=Slider(23, range=0..23))  # -> period, hoys, dates; plug-in component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
panel_2 = Panel("a>24")
sunpath = LBSunPath(location=importloc, hoys=analysisperiod_2.hoys, scale=1, data=importepw.dry_bulb_temperature)  # -> report, vectors, altitudes, azimuths, hoys, sun_pts, analemma, daily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; plug-in component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
msphere = MeshSphere(Base=sunpath.sun_pts, Radius=Slider(3, range=0..10), UCount=10, VCount=20)

# ----
run_incident_radiation_study_2 = Boolean(run_incident_radiation_study)

# ---- group: Sky matrix and incident radiation
analysisperiod_3 = LBAnalysisPeriod(
    start_month=Slider(1, range=1..12),
    start_day=Slider(1, range=1..31),
    start_hour=Slider(0, range=0..23),
    end_month=Slider(12, range=1..12),
    end_day=Slider(31, range=1..31),
    end_hour=Slider(23, range=0..23))  # -> period, hoys, dates; plug-in component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
skymatrix = LBCumulativeSkyMatrix(
    location=importepw.location,
    direct_rad=importepw.direct_normal_rad,
    diffuse_rad=importepw.diffuse_horizontal_rad,
    hoys=analysisperiod_3.hoys,
    high_density=Toggle(False))  # -> report, sky_mtx; plug-in component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
context_geometry = Geometry(target_geometry)
target_geometry_3 = Geometry(target_geometry_2)
incidentradiation = LBIncidentRadiation(
    sky_mtx=skymatrix.sky_mtx,
    geometry=flatten(target_geometry_3),
    context=flatten(context_geometry),
    grid_size=Slider(1, range=0..1),
    offset_dist=Slider(0.1, range=0..0.1),
    run=run_incident_radiation_study_2)  # -> report, points, results, total, mesh, legend, title, int_mtx; plug-in component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
skydome = LBSkyDome(sky_mtx=skymatrix.sky_mtx)  # -> report, mesh, compass, legend, title, patch_vecs, patch_values, mesh_values, vis_set; plug-in component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

# ---- group: Graph data
timeop = LBTimeIntervalOperation(data=importepw.dry_bulb_temperature)  # -> daily, monthly, mon_per_hr; plug-in component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
legendpar = LBLegendParameters(
    min=Slider(-15, range=-15..30),
    max=Slider(25, range=0..100),
    num_decimals=Slider(0, range=0..100),
    larger_smaller=Toggle(True),
    vert_or_horiz=Toggle(False))  # -> leg_par; plug-in component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
monthlychart = LBMonthlyChart(data=timeop.daily)  # -> report, data_mesh, data_lines, col_lines, legend, borders, labels, y_title, title, vis_set; plug-in component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
hourlyplot = LBHourlyPlot(data=importepw.dry_bulb_temperature, z_dim=Slider(0, range=0..100), reverse_y=Toggle(True), legend_par=legendpar)  # -> report, mesh, legend, borders, labels, title, vis_set; plug-in component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

# ----
merge = Merge(
    Data1=windrose.mesh,
    Data2=windrose.compass,
    Data3=windrose.orient_line,
    Data4=windrose.freq_line,
    Data5=windrose.windrose_line,
    Data6=windrose.legend,
    Data7=windrose.title)
run_direct_sun_hours_study_2 = Boolean(run_direct_sun_hours_study)

# ---- group: Direct sun hours
toggle = BooleanToggle(True)
target_geometry_4 = Geometry(target_geometry_2)
context_geometry_2 = Geometry(target_geometry)
directsunhours = LBDirectSunHours(
    vectors=flatten(sunpath.vectors),
    geometry=flatten(target_geometry_4),
    context=flatten(context_geometry_2),
    grid_size=Slider(1, range=0..10),
    offset_dist=Slider(0.1, range=0..1),
    run=run_direct_sun_hours_study_2)  # -> report, points, results, mesh, legend, title, int_mtx; plug-in component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

# ---- group: Sky mask
sky_mask_centre_point_2 = Point(sky_mask_centre_point)
symask = LBSkyMask(
    context=context_geometry_2,
    density=Slider(3, range=0..10),
    center=sky_mask_centre_point_2,
    scale=Slider(0.1, range=0..1))  # -> report, context_mask, orient_mask, strategy_mask, sky_mask, context_view, orient_view, strategy_view, sky_view; plug-in component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

# ----
merge_2 = Merge(Data1=incidentradiation.mesh, Data2=incidentradiation.legend, Data3=incidentradiation.title)  # -> flatten(IncidentRadiation)
merge_3 = Merge(Data1=skydome.mesh, Data2=skydome.compass, Data3=skydome.legend, Data4=skydome.title)  # -> flatten(SkyDome)
merge_4 = Merge(
    Data1=monthlychart.data_mesh,
    Data2=monthlychart.legend,
    Data3=monthlychart.borders,
    Data4=monthlychart.labels,
    Data5=monthlychart.y_title,
    Data6=monthlychart.title)  # -> flatten(DryBulbTemperatureLineChart)
merge_5 = Merge(
    Data1=hourlyplot.mesh,
    Data2=hourlyplot.legend,
    Data3=hourlyplot.borders,
    Data4=hourlyplot.labels,
    Data5=hourlyplot.title)
sky_dome = ClusterOutput(merge_3)
wind_rose = ClusterOutput(merge)
dry_bulb_temperature_line_chart = ClusterOutput(merge_4)
dry_bulb_temperature_2d_chart = ClusterOutput(merge_5)
direct_sun_hours = Merge(Data1=directsunhours.mesh, Data2=directsunhours.legend, Data3=directsunhours.title)  # -> flatten(DirectSunHours)
incident_radiation = ClusterOutput(merge_2)
direct_sun_hours_2 = ClusterOutput(direct_sun_hours)
merge_6 = Merge(Data1=symask.context_mask, Data2=symask.sky_mask)
sky_mask = ClusterOutput(merge_6)

# ==== cluster Glare
run_glare_analysis = ClusterInput()
epw_file_url = ClusterInput()
viewport_name = ClusterInput()
epw_file_url_2 = ClusterInput()
month = ClusterInput()
day = ClusterInput()
hour = ClusterInput()
epw_file_url_3 = Data(epw_file_url)
run_glare_analysis_2 = Boolean(run_glare_analysis)
day_2 = Number(day)
hour_2 = Number(hour)
month_2 = Number(month)

# ---- group: Glare analysis
epw_file_url_4 = Data(epw_file_url_2)
viewport_name_2 = Data(viewport_name)
pt = ConstructPoint(XCoordinate=Slider(6, range=0..10), YCoordinate=Slider(5, range=0..10), ZCoordinate=Slider(2, range=0..10))
viewport = HBViewFromViewport(name=viewport_name_2, viewport=viewport_name_2, view_type=Slider(4, range=0..5))  # -> view; plug-in component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
pt_2 = ConstructPoint(XCoordinate=Slider(4, range=0..10), YCoordinate=Slider(4, range=0..10), ZCoordinate=Slider(1.6, range=0..10))
vec2pt = Vector2Pt(PointA=pt_2, PointB=pt, Unitize=False)  # -> Vector, Length
assigngridsviews = HBAssignGridsAndViews(model=epw_file_url_3, views=flatten(viewport))  # -> model; plug-in component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
view = HBView(position=pt_2, direction=vec2pt.Vector, view_type=Slider(4, range=0..5))  # -> view; plug-in component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
hoy = LBCalculateHOY(month=month_2, day=day_2, hour=hour_2)  # -> flatten(hoy), flatten(doy), flatten(date); plug-in component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

# ----
downloadepw = LBDownloadWeather(weather_URL=epw_file_url_4)  # -> epw_file, stat_file, ddy_file; plug-in component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

# ---- group: Glare analysis (continued)
importloc = LBImportLocation(epw_file=downloadepw.epw_file)  # -> location; plug-in component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
ciesky = HBCIEStandardSky(location=importloc, month=month_2, day=day_2, hour=hour_2, type=0)  # -> sky; plug-in component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
pitview = HBPointInTimeViewBased(model=assigngridsviews, sky=ciesky, run=run_glare_analysis_2)  # -> report, results; plug-in component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
glare = HBGlarePostprocess(hdr=pitview.results)  # -> DGP, category, glare_indices, check_hdr; plug-in component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
merge = Merge(Data1=hoy.date, Data2=glare.category, Data3=glare.DGP)
daylight_glare_probability_dgp = Data(glare.DGP)
join = TextJoin(Text=merge)
falsecolor = HBFalseColor(hdr=pitview.results, max=Slider(2300, range=0..10000), contour_lines=Toggle(True))  # -> hdr; plug-in component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
adjusthdr = HBAdjustHDR(hdr=pitview.results, adj_expos=Toggle(True), label=join)  # -> hdr; plug-in component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
hdr_image = Data(adjusthdr)
hdr_false_color_image = Data(falsecolor)

# ----
daylight_glare_probability_dgp_2 = ClusterOutput(daylight_glare_probability_dgp)
hdr_image_2 = ClusterOutput(hdr_image)
hdr_false_color_image_2 = ClusterOutput(hdr_false_color_image)

# ==== cluster DaylightMetrics
epw_file_url = ClusterInput()
epw_file_url_2 = Data(epw_file_url)
run_annual_daylight_simulation = ClusterInput()
run_illuminance = ClusterInput()
month_illuminance = ClusterInput()
day_illuminance = ClusterInput()
honeybee_model = ClusterInput()
hour_illuminance = ClusterInput()
detail_level_0_2 = ClusterInput()
grid_size = ClusterInput()
downloadepw = LBDownloadWeather(weather_URL=epw_file_url_2)  # -> epw_file, stat_file, ddy_file; plug-in component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
deconstructmodel = HBDeconstructModel(model=honeybee_model)  # -> rooms, faces, apertures, doors, shades; plug-in component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
decnstrobj = HBDeconstructObject(hb_obj=deconstructmodel.rooms)  # -> faces, apertures, doors, shades; plug-in component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
# Create analysis grid
vizquick = HBVisualizeQuick(hb_objs=decnstrobj.faces)  # -> geo; plug-in component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
detail_level_0_2_2 = Number(detail_level_0_2)
area = Area(Geometry=vizquick)  # -> Area, Centroid
pdecon = Deconstruct(Point=area.Centroid)  # -> XComponent, YComponent, ZComponent
sort = SortList(Keys=pdecon.ZComponent, ValuesA=vizquick)  # -> Keys, ValuesA
honeybee_model_2 = Data(honeybee_model)
grid_size_2 = Number(grid_size)

# ---- group: Set up sensor grids
srf = Surface(sort.ValuesA)
item = ListItem(List=srf, Index=Slider(0, range=0..5), Wrap=True)
flip = Flip(Surface=item)  # -> Surface, Result
# Alternatively create grid from surface
genpts = LBGeneratePointGrid(geometry=flip.Surface, grid_size=Slider(1, range=0..5), offset_dist=Slider(0.7, range=0..5))  # -> points, vectors, face_areas, mesh; plug-in component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
gridrooms = HBSensorGridFromRooms(rooms=honeybee_model_2, grid_size=grid_size_2, dist_floor=Slider(0.7, range=0..5))  # -> grid, points, mesh; plug-in component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
sensorgrid = HBSensorGrid(positions=genpts.points, directions=genpts.vectors, mesh=genpts.mesh)  # -> grid; plug-in component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
assigngridsviews = HBAssignGridsAndViews(model=honeybee_model_2, grids=flatten(gridrooms.grid))  # -> model; plug-in component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

# ----
grid_mesh = Data(gridrooms.mesh)
honeybee_model_3 = Data(assigngridsviews)
run_annual_daylight_simulation_2 = Boolean(run_annual_daylight_simulation)
detail_level_0_2_3 = Number(detail_level_0_2)
honeybee_model_4 = Data(honeybee_model_3)
run_illuminance_2 = Boolean(run_illuminance)

# ---- group: Simulate illuminance
importloc = LBImportLocation(epw_file=downloadepw.epw_file)  # -> location; plug-in component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
day_illuminance_2 = Number(day_illuminance)
hour_illuminance_2 = Number(hour_illuminance)
month_illuminance_2 = Number(month_illuminance)
radpar = HBRadianceParameter(recipe_type=Slider(0, range=0..2), detail_level=detail_level_0_2_3)  # -> rad_par; plug-in component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
ciesky = HBCIEStandardSky(location=importloc, month=month_illuminance_2, day=day_illuminance_2, hour=hour_illuminance_2, type=0)  # -> sky; plug-in component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
mjoin = MeshJoin(Meshes=grid_mesh)
legendpar = LBLegendParameters(max=Slider(2000, range=0..10000))  # -> leg_par; plug-in component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
pitgrid = HBPointInTimeGridBased(model=honeybee_model_3, sky=ciesky, radiance_par=radpar, run=run_illuminance_2)  # -> report, flatten(results); plug-in component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
heatmap = LBSpatialHeatmap(values=pitgrid.results, mesh=mjoin, legend_par=legendpar, legend_title="Lux", global_title="Illuminance")  # -> mesh, legend, title, colors, legend_par, vis_set; plug-in component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

# ----
cluster = Cluster_2()
merge = Merge(Data1=heatmap.mesh, Data2=heatmap.legend, Data3=heatmap.title)  # -> flatten(Result)
illuminance_lux = Data(merge)
X = UnitX(Factor=Slider(0, range=0..400))
illuminance_lux_2 = ClusterOutput(illuminance_lux)

# ---- group: Spatial climate based daylight
panel = Panel("-t 50 -lt 200 -ut 2000")
radpar_2 = HBRadianceParameter(recipe_type=Slider(2, range=0..2), detail_level=detail_level_0_2_2, additional_par="-ab 4")  # -> rad_par; plug-in component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
wea = HBWeaFromEPW(epw_file=downloadepw.epw_file)  # -> wea; plug-in component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
analysis_mesh = Mesh(grid_mesh)
annualdaylight = HBAnnualDaylight(
    model=honeybee_model_4,
    wea=wea,
    schedule="Generic Office Occupancy",
    radiance_par=radpar_2,
    run=run_annual_daylight_simulation_2)  # -> report, results, DA, cDA, UDI, UDI_low, UDI_up; plug-in component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
panel_2 = Panel(radpar_2)
mjoin_2 = MeshJoin(Meshes=analysis_mesh)
cluster_2 = Cluster_2()
cluster_3 = Cluster_2()
cluster_4 = Cluster_2()
heatmap_2 = LBSpatialHeatmap(values=flatten(annualdaylight.UDI_up), mesh=mjoin_2, legend_par=cluster_2, legend_title="UDI >3000 [%]")  # -> mesh, legend, title, colors, legend_par, vis_set; plug-in component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
heatmap_3 = LBSpatialHeatmap(values=flatten(annualdaylight.UDI_low), mesh=mjoin_2, legend_par=cluster_3, legend_title="UDI <50 [%]")  # -> mesh, legend, title, colors, legend_par, vis_set; plug-in component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
heatmap_4 = LBSpatialHeatmap(values=flatten(annualdaylight.UDI), mesh=mjoin_2, legend_par=cluster_4, legend_title="UDI [%]")  # -> mesh, legend, title, colors, legend_par, vis_set; plug-in component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
sda = HBSpatialDaylightAutonomy(DA=flatten(annualdaylight.DA), mesh=mjoin_2)  # -> report, sDA, pass_fail; plug-in component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
heatmap_5 = LBSpatialHeatmap(values=flatten(annualdaylight.DA), mesh=mjoin_2, legend_par=cluster, legend_title="Daylight autonomy [%]")  # -> mesh, legend, title, colors, legend_par, vis_set; plug-in component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
X_2 = UnitX(Factor=Slider(150, range=0..400))
X_3 = UnitX(Factor=Slider(100, range=0..400))
X_4 = UnitX(Factor=Slider(50, range=0..400))
panel_3 = Panel(sda.sDA)

# ---- group: Extract hourly data from annual results
facen = FaceNormals(Mesh=mjoin_2)  # -> Centers, Normals
pt = Point(facen.Centers)
flatten = FlattenTree(Tree=pt, Path="{0}")
item_2 = ListItem(List=flatten, Index=Slider(581, range=0..1000), Wrap=True)
number_slider = Slider(0.1, range=0..0.1)
annualtodata = HBAnnualResultsToData(results=annualdaylight.results, sel_pts=flatten(item_2), all_pts=pt)  # -> report, data; plug-in component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
legendpar_2 = LBLegendParameters(max=Slider(3000, range=0..3000))  # -> leg_par; plug-in component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
pt_2 = Point(Point(0, 35, 0))
multiplication = Multiplication(A=number_slider, B=4)
hourlyplot = LBHourlyPlot(data=annualtodata.data, base_pt=pt_2, x_dim=number_slider, y_dim=multiplication, legend_par=legendpar_2)  # -> report, mesh, legend, borders, labels, title, vis_set; plug-in component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
sph = Sphere(Base=item_2, Radius=Slider(1.2, range=0..5))
merge_2 = Merge(Data1=sph, Data2=hourlyplot.mesh, Data3=hourlyplot.legend, Data4=hourlyplot.labels)  # -> flatten(Result)

# ----
udi_50 = Data(flatten([heatmap_3.mesh, heatmap_3.legend, heatmap_3.title]))
udi_3000 = Data(flatten([heatmap_2.mesh, heatmap_2.legend, heatmap_2.title]))
udi = Data(flatten([heatmap_4.mesh, heatmap_4.legend, heatmap_4.title]))
daylight_autonomy = Data(flatten([heatmap_5.mesh, heatmap_5.legend, heatmap_5.title]))
move = Move(Geometry=daylight_autonomy, Motion=X)  # -> Geometry, Transform

# ---- group: Spatial climate based daylight (continued)
move_2 = Move(Geometry=udi_3000, Motion=X_2)  # -> Geometry, Transform
move_3 = Move(Geometry=udi_50, Motion=X_3)  # -> Geometry, Transform
move_4 = Move(Geometry=udi, Motion=X_4)  # -> Geometry, Transform
merge_3 = Merge(Data1=move.Geometry, Data2=move_4.Geometry, Data3=move_3.Geometry, Data4=move_2.Geometry)

# ----
spatial_daylight_autonomy = Data(sda.sDA)
hourly_results_in_one_point = Data(merge_2)
udi_3000_2 = ClusterOutput(udi_3000)
daylight_autonomy_2 = ClusterOutput(daylight_autonomy)
udi_2 = ClusterOutput(udi)
spatial_daylight_autonomy_2 = ClusterOutput(spatial_daylight_autonomy)
udi_50_2 = ClusterOutput(udi_50)
data = Data(merge_3)

# ==== cluster SimpleEnergySimulations
run_energy_balance = ClusterInput()
run_peak_loads = ClusterInput()
honeybee_rooms = ClusterInput()
shading_geometry = ClusterInput()
graph_max = ClusterInput()
epw_file_url = ClusterInput()
epw_file_url_2 = Data(epw_file_url)
graph_max_2 = Number(graph_max)
downloadepw = LBDownloadWeather(weather_URL=epw_file_url_2)  # -> epw_file, stat_file, ddy_file; plug-in component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
run_peak_loads_2 = Boolean(run_peak_loads)

# ---- group: Simple energy balance
data = Data(shading_geometry)
data_2 = Data(honeybee_rooms)
run_energy_balance_2 = Boolean(run_energy_balance)
annualloads = HBAnnualLoads(
    rooms=flatten(data_2),
    shades=data,
    epw_file=downloadepw.epw_file,
    run_bal=run_energy_balance_2,
    run=run_energy_balance_2)  # -> report, total_load, cooling, heating, lighting, equip, process, hot_water, balance; plug-in component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
panel = Panel(annualloads.total_load)
number_slider = Slider(50, range=0..100)
colrange = LBColorRange(index=Slider(19, range=0..100))  # -> colors; plug-in component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
neg = Negative(Value=number_slider)
legendpar = LBLegendParameters(min=neg, max=number_slider, colors=colrange)  # -> leg_par; plug-in component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
monthlychart = LBMonthlyChart(data=annualloads.balance, stack=Toggle(True), legend_par=legendpar)  # -> report, data_mesh, data_lines, col_lines, legend, borders, labels, y_title, title, vis_set; plug-in component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

# ----
colrange_2 = LBColorRange(index=Slider(0, range=0..26))  # -> colors; plug-in component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
colrange_3 = LBColorRange(index=Slider(26, range=0..26))  # -> colors; plug-in component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
honeybee_rooms_2 = Data(honeybee_rooms)
shading_geometry_2 = Data(shading_geometry)
annual_energy_balance = Data(flatten([monthlychart.data_mesh, monthlychart.data_lines, monthlychart.col_lines, monthlychart.legend, monthlychart.borders, monthlychart.labels, monthlychart.y_title, monthlychart.title]))
annual_energy_balance_2 = ClusterOutput(annual_energy_balance)

# ---- group: Simle peak loads
neg_2 = Negative(Value=graph_max_2)
data_3 = Data(downloadepw.ddy_file)
legendpar_2 = LBLegendParameters(min=neg_2, max=graph_max_2)  # -> leg_par; plug-in component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
peakloads = HBPeakLoads(rooms=honeybee_rooms_2, shades=shading_geometry_2, ddy_file=data_3, run_bal=run_peak_loads_2, run=run_peak_loads_2)  # -> report, peak_cool, peak_heat, cooling, heating, cool_bal, heat_bal; plug-in component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
toggle = BooleanToggle(True)
toggle_2 = BooleanToggle(True)
pt = Point(Point(0, 50, 0))
pt_2 = Point(Point(0, 50, 0))
toggle_3 = BooleanToggle(True)
toggle_4 = BooleanToggle(True)
monthlychart_2 = LBMonthlyChart(data=peakloads.heat_bal, x_dim=Slider(40, range=0..100), stack=toggle_2, time_marks=toggle_2, legend_par=legendpar_2)  # -> report, data_mesh, data_lines, col_lines, legend, borders, labels, y_title, title, vis_set; plug-in component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
monthlychart_3 = LBMonthlyChart(
    data=peakloads.cooling,
    base_pt=pt_2,
    x_dim=Slider(40, range=0..100),
    stack=toggle_3,
    time_marks=toggle_3,
    legend_par=legendpar_2)  # -> report, data_mesh, data_lines, col_lines, legend, borders, labels, y_title, title, vis_set; plug-in component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
daily_cooling_profile = Data(flatten([monthlychart_3.data_mesh, monthlychart_3.data_lines, monthlychart_3.col_lines, monthlychart_3.legend, monthlychart_3.borders, monthlychart_3.labels, monthlychart_3.y_title, monthlychart_3.title]))
heating_balance_design_day = Data(flatten([monthlychart_2.data_mesh, monthlychart_2.data_lines, monthlychart_2.col_lines, monthlychart_2.legend, monthlychart_2.borders, monthlychart_2.labels, monthlychart_2.y_title, monthlychart_2.title]))

# ----
cluster = Cluster_3(min=neg_2, max=graph_max_2, colors=colrange_2)
cluster_2 = Cluster_3(min=neg_2, max=graph_max_2, colors=colrange_3)

# ---- group: Simle peak loads (continued)
monthlychart_4 = LBMonthlyChart(
    data=peakloads.heating,
    base_pt=pt,
    x_dim=Slider(40, range=0..100),
    stack=toggle,
    time_marks=toggle,
    legend_par=cluster_2)  # -> report, data_mesh, data_lines, col_lines, legend, borders, labels, y_title, title, vis_set; plug-in component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
monthlychart_5 = LBMonthlyChart(data=peakloads.cool_bal, x_dim=Slider(40, range=0..100), stack=toggle_4, time_marks=toggle_4, legend_par=cluster)  # -> report, data_mesh, data_lines, col_lines, legend, borders, labels, y_title, title, vis_set; plug-in component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
daily_heating_profile = Data(flatten([monthlychart_4.data_mesh, monthlychart_4.data_lines, monthlychart_4.col_lines, monthlychart_4.legend, monthlychart_4.borders, monthlychart_4.labels, monthlychart_4.y_title, monthlychart_4.title]))
cooling_balance_design_day = Data(flatten([monthlychart_5.data_mesh, monthlychart_5.data_lines, monthlychart_5.col_lines, monthlychart_5.legend, monthlychart_5.borders, monthlychart_5.y_title, monthlychart_5.labels, monthlychart_5.title]))

# ----
cooling_balance_design_day_2 = ClusterOutput(cooling_balance_design_day)
heating_balance_design_day_2 = ClusterOutput(heating_balance_design_day)
daily_heating_profile_2 = ClusterOutput(daily_heating_profile)
daily_cooling_profile_2 = ClusterOutput(daily_cooling_profile)

# ==== cluster DetailedEnergySimulations

# ---- group: Request specific outputs
toggle = BooleanToggle(True)
simoutput = HBSimulationOutput(zone_energy_use=toggle, gains_and_losses=toggle, comfort_metrics=toggle, surface_energy_flow=toggle)  # -> report, sim_output; plug-in component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
simpar = HBSimulationParameter(output=simoutput.sim_output, timestep=6)  # -> sim_par; plug-in component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

# ----
epw_file_url = ClusterInput()
honeybee_model = ClusterInput()
run_energy_simulation = ClusterInput()
honeybee_model_2 = Data(honeybee_model)
epw_file_url_2 = Data(epw_file_url)
downloadepw = LBDownloadWeather(weather_URL=epw_file_url_2)  # -> epw_file, stat_file, ddy_file; plug-in component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

# ---- group: Simulate
honeybee_model_3 = Data(honeybee_model_2)
run_energy_simulation_2 = Boolean(run_energy_simulation)
modeltoosm = HBModelToOSM(
    model=honeybee_model_3,
    epw_file=downloadepw.epw_file,
    sim_par=simpar,
    write=run_energy_simulation_2,
    run=run_energy_simulation_2)  # -> report, jsons, osw, osm, idf, sql, zsz, rdd, html; plug-in component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
eui = HBEndUseIntensity(sql=modeltoosm.sql)  # -> eui, eui_end_use, end_uses, gross_floor; plug-in component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
panel = Panel(eui.eui)
panel_2 = Panel(eui.end_uses)
panel_3 = Panel(eui.eui_end_use)

# ---- group: Peak loads
readhvac = HBReadHVACSizing(sql=modeltoosm.sql)  # -> zone_names, zone_peak_cool, zone_peak_heat, comp_types, comp_properties, comp_values; plug-in component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
readzsz = HBReadZoneSizing(zsz=modeltoosm.zsz)  # -> cooling_load, heating_load; plug-in component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
toggle_2 = BooleanToggle(True)
toggle_3 = BooleanToggle(True)
panel_4 = Panel([readhvac.zone_peak_heat, readhvac.zone_peak_cool])
monthlychart = LBMonthlyChart(data=readzsz.heating_load, x_dim=Slider(40, range=0..100), stack=toggle_2, time_marks=toggle_2)  # -> report, data_mesh, data_lines, col_lines, legend, borders, labels, y_title, title, vis_set; plug-in component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
monthlychart_2 = LBMonthlyChart(data=readzsz.cooling_load, x_dim=Slider(40, range=0..100), stack=toggle_3, time_marks=toggle_3)  # -> report, data_mesh, data_lines, col_lines, legend, borders, labels, y_title, title, vis_set; plug-in component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
heating_load_profile = Data(flatten([monthlychart.data_mesh, monthlychart.data_lines, monthlychart.col_lines, monthlychart.legend, monthlychart.borders, monthlychart.labels, monthlychart.y_title, monthlychart.title]))
cooling_load_profile = Data(flatten([monthlychart_2.data_mesh, monthlychart_2.data_lines, monthlychart_2.col_lines, monthlychart_2.legend, monthlychart_2.borders, monthlychart_2.labels, monthlychart_2.y_title, monthlychart_2.title]))
peak_heating = Data(readhvac.zone_peak_heat)

# ---- group: Load previous model
falsestart = LBFalseStartToggle(False)
item = ListItem(List=modeltoosm.jsons, Index=0, Wrap=True)
loadobjects = HBLoadObjects(hb_file=item, load=falsestart)  # -> report, hb_objs; plug-in component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

# ---- group: extract and visualise data
roomenergyresult = HBReadRoomEnergyResult(sql=modeltoosm.sql)  # -> cooling, heating, lighting, electric_equip, gas_equip, process, hot_water, fan_electric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; plug-in component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
merge = Merge(
    Data1=roomenergyresult.heating,
    Data2=roomenergyresult.cooling,
    Data3=roomenergyresult.lighting,
    Data4=roomenergyresult.electric_equip,
    Data5=roomenergyresult.hot_water,
    Data6=roomenergyresult.people_gain,
    Data7=roomenergyresult.solar_gain)
hourlyplot = LBHourlyPlot(data=merge)  # -> report, mesh, legend, borders, labels, title, vis_set; plug-in component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
xdata = LBDeconstructData(data=roomenergyresult.cooling)  # -> header, values; plug-in component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

# ----
energy_use_intensity = Data(eui.eui)
energy_use_intensity_per_end_use = Data(eui.eui_end_use)
end_uses = Data(eui.end_uses)
peak_cooling = Data(readhvac.zone_peak_cool)
data = Data(honeybee_model_2)
number_slider = Slider(50, range=0..100)

# ---- group: Energy balance
faceresult = HBReadFaceResult(sql=modeltoosm.sql)  # -> face_indoor_temp, face_outdoor_temp, face_energy_flow; plug-in component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
loadbalance = HBThermalLoadBalance(
    rooms_model=flatten(data),
    cooling=roomenergyresult.cooling,
    heating=roomenergyresult.heating,
    lighting=roomenergyresult.lighting,
    electric_equip=roomenergyresult.electric_equip,
    hot_water=roomenergyresult.hot_water,
    people_gain=roomenergyresult.people_gain,
    solar_gain=roomenergyresult.solar_gain,
    infiltration_load=roomenergyresult.infiltration_load,
    mech_vent_load=roomenergyresult.mech_vent_load,
    face_energy_flow=faceresult.face_energy_flow)  # -> report, balance, balance_stor, norm_bal, norm_bal_stor; plug-in component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
timeop = LBTimeIntervalOperation(data=loadbalance.norm_bal_stor)  # -> daily, monthly, mon_per_hr; plug-in component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
colrange = LBColorRange(index=Slider(19, range=0..100))  # -> colors; plug-in component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
neg = Negative(Value=number_slider)
legendpar = LBLegendParameters(min=neg, max=number_slider, colors=colrange)  # -> leg_par; plug-in component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
monthlychart_3 = LBMonthlyChart(data=timeop.monthly, stack=Toggle(True), legend_par=legendpar)  # -> report, data_mesh, data_lines, col_lines, legend, borders, labels, y_title, title, vis_set; plug-in component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

# ----
monthly_energy_balance = Data(flatten([monthlychart_3.data_mesh, monthlychart_3.data_lines, monthlychart_3.col_lines, monthlychart_3.legend, monthlychart_3.borders, monthlychart_3.labels, monthlychart_3.y_title, monthlychart_3.title]))
annual_hourly_energy_results = Data(flatten([hourlyplot.mesh, hourlyplot.legend, hourlyplot.borders, hourlyplot.labels, hourlyplot.title]))
energy_use_intensity_2 = ClusterOutput(energy_use_intensity)
energy_use_intensity_per_end_use_2 = ClusterOutput(energy_use_intensity_per_end_use)
end_uses_2 = ClusterOutput(end_uses)
annual_hourly_energy_results_2 = ClusterOutput(annual_hourly_energy_results)
monthly_energy_balance_2 = ClusterOutput(monthly_energy_balance)
peak_heating_2 = ClusterOutput(peak_heating)
heating_load_profile_2 = ClusterOutput(heating_load_profile)
cooling_load_profile_2 = ClusterOutput(cooling_load_profile)
peak_cooling_2 = ClusterOutput(peak_cooling)

# ==== cluster CreateHoneybeeModel
subdivide_generated_windows = ClusterInput()
horizontal_separation = ClusterInput()
window_to_wall_ratio = ClusterInput()
vertical_separation = ClusterInput()
window_height = ClusterInput()
wall_thickness = ClusterInput()
roof_thickness = ClusterInput()
construction_set = ClusterInput()
sill_height = ClusterInput()
context_geometry = ClusterInput()
louver_depth = ClusterInput()
program = ClusterInput()
model_name = ClusterInput()
number_of_louvers = ClusterInput()
distance_between_louvers = ClusterInput()
louver_angle = ClusterInput()
vertical_horizontal_louvers = ClusterInput()
skylights = ClusterInput()
windows = ClusterInput()
room_geometry = ClusterInput()
vertical_separation_2 = Number(vertical_separation)
horizontal_separation_2 = Number(horizontal_separation)
sill_height_2 = Number(sill_height)
window_height_2 = Number(window_height)
window_to_wall_ratio_2 = Number(window_to_wall_ratio)
subdivide_generated_windows_2 = Boolean(subdivide_generated_windows)
number_slider = Slider(12.3, range=0..100)
room_geometry_2 = Geometry(room_geometry)
program_2 = Data(program)
skylights_2 = Geometry(skylights)
model_name_2 = Text(model_name)
windows_2 = Geometry(windows)
wall_thickness_2 = Number(wall_thickness)
roof_thickness_2 = Number(roof_thickness)
context_geometry_2 = Geometry(context_geometry)
intsolid = HBIntersectSolids(solids=room_geometry_2, run=Toggle(True))  # -> int_solids; plug-in component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
construction_set_2 = Data(construction_set)
program_3 = Data(program)
aperture = HBAperture(geo=skylights_2)  # -> report, apertures; plug-in component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
vertical_horizontal_louvers_2 = Boolean(vertical_horizontal_louvers)
louver_depth_2 = Number(louver_depth)
number_of_louvers_2 = Number(number_of_louvers)
louver_angle_2 = Number(louver_angle)
distance_between_louvers_2 = Number(distance_between_louvers)
bordershades = HBExtrudedBorderShades(hb_objs=flatten(aperture.apertures), depth=roof_thickness_2)  # -> report, hb_objs; plug-in component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

# ---- group: add shades and louvers
shade = HBShade(geo=context_geometry_2)  # -> report, shades; plug-in component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
roomsolid = HBRoomFromSolid(geo=flatten(intsolid), constr_set=construction_set_2, program=program_3, conditioned=True)  # -> report, rooms; plug-in component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
aperture_2 = HBAperture(geo=windows_2)  # -> report, apertures; plug-in component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
solveadj = HBSolveAdjacency(rooms=flatten(roomsolid.rooms), run=Toggle(True))  # -> report, adj_rooms; plug-in component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
panel = Panel(model_name_2)

# ----
vizquick = HBVisualizeQuick(hb_objs=flatten(shade.shades))  # -> geo; plug-in component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
aperturesbyratio = HBAperturesByRatio(
    hb_objs=flatten(roomsolid.rooms),
    ratio=window_to_wall_ratio_2,
    subdivide=subdivide_generated_windows_2,
    win_height=window_height_2,
    sill_height=sill_height_2,
    horiz_separ=horizontal_separation_2,
    vert_separ=vertical_separation_2)  # -> report, hb_objs; plug-in component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

# ---- group: If no window geometries are supplied, instead generate using WWR
null = NullItem(Item=aperture_2.apertures)  # -> NullFlags, InvalidFlags, Description
item = ListItem(List=null.NullFlags, Index=0, Wrap=True)
filter = StreamFilter(Gate=item, Stream0=aperture_2.apertures, Stream1=aperturesbyratio.hb_objs)

# ---- group: add shades and louvers (continued)
bordershades_2 = HBExtrudedBorderShades(hb_objs=flatten(filter), depth=wall_thickness_2)  # -> report, hb_objs; plug-in component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

# ----
louvershades = HBLouverShades(
    hb_objs=flatten(bordershades_2.hb_objs),
    depth=louver_depth_2,
    shade_count=number_of_louvers_2,
    dist_between=distance_between_louvers_2,
    angle=louver_angle_2,
    vertical=vertical_horizontal_louvers_2)  # -> report, hb_objs; plug-in component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

# ---- group: Bypass if no louvers were generated
null_2 = NullItem(Item=louvershades.hb_objs)  # -> NullFlags, InvalidFlags, Description
item_2 = ListItem(List=null_2.NullFlags, Index=0, Wrap=True)
filter_2 = StreamFilter(Gate=item_2, Stream0=louvershades.hb_objs, Stream1=bordershades_2.hb_objs)

# ---- group: If either skylights or windows are empty, filter them
merge = Merge(Data1=filter_2, Data2=bordershades.hb_objs)
null_3 = NullItem(Item=merge)  # -> NullFlags, InvalidFlags, Description
not = GateNot(A=null_3.NullFlags)
cull = CullPattern(List=merge, CullPattern=not)

# ---- group: add shades and louvers (continued)
addsubface = HBAddSubface(hb_obj=flatten(solveadj.adj_rooms), sub_faces=flatten(cull))  # -> hb_obj; plug-in component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
model = HBModel(rooms=flatten(addsubface), shades=flatten(shade.shades), name=panel)  # -> report, model; plug-in component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

# ----
honeybee_model = Data(model.model)
honeybee_model_2 = ClusterOutput(honeybee_model)

# ==== cluster VisualiseProperties
number_of_decimals_room = ClusterInput()
face_attribute = ClusterInput()
honeybee_model = ClusterInput()
number_of_decimals_face = ClusterInput()
room_attribute = ClusterInput()
face_attribute_2 = Text(face_attribute)
honeybee_model_2 = Data(honeybee_model)
room_attribute_2 = Text(room_attribute)
number_of_decimals_face_2 = Number(number_of_decimals_face)
legendpar = LBLegendParameters(num_decimals=number_of_decimals_face_2)  # -> leg_par; plug-in component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
number_of_decimals_room_2 = Number(number_of_decimals_room)
legendpar_2 = LBLegendParameters(num_decimals=number_of_decimals_room_2)  # -> leg_par; plug-in component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
colorfaceattr = HBColorFaceAttributes(hb_objs=flatten(honeybee_model_2), attribute=face_attribute_2, legend_par=legendpar)  # -> mesh, legend, wire_frame, values, colors, vis_set; plug-in component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
colorroomattr = HBColorRoomAttributes(rooms_model=flatten(honeybee_model_2), attribute=room_attribute_2, legend_par=legendpar_2)  # -> mesh, legend, wire_frame, values, colors, vis_set; plug-in component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
visualised_face_attributes = Data([colorfaceattr.mesh, colorfaceattr.legend, colorfaceattr.wire_frame])
visualised_room_attributes = Data([colorroomattr.mesh, colorroomattr.legend, colorroomattr.wire_frame])
visualised_face_attributes_2 = ClusterOutput(visualised_face_attributes)
visualised_room_attributes_2 = ClusterOutput(visualised_room_attributes)

# ==== cluster Cluster_4
honeybee_model = ClusterInput()
list = ValueList({"Swedish": "sv", "English": "en"}, selected="English")

# ----
# Get Klimatdatabas data
panel = Panel("./database.json")
list_2 = ValueList({"File": "file", "API": "api"}, selected="API")
get_categories = Brimstone1GetCategories(mode=list_2, language=list, json_path=panel)  # -> out, json_data, categories, klimatdatabas_version
# ---------- get_categories: Python ----------
"""Gets Klimatdatabas from the Boverket API or a file, extracts json data, and resource category names
    Inputs:
        mode: api or file mode
        language: language of database to retrieve
        json_path: path to json file if file mode
    Output:
        json_data: json file as dictionary
        categories: Categories present in the database
        klimatdatabas_version: String representing the version of Klimatdatabas used"""

import scriptcontext

ghenv.Component.Name = 'Brimstone - 1. Get Categories'
ghenv.Component.NickName = 'Get Categories'
ver = scriptcontext.sticky["brimstone_version"]
ghenv.Component.Message = ver

import json

from System.Net import WebRequest
from System.IO import StreamReader
from System.Text import Encoding

def main(mode, json_path):    
    if mode == "file":
        json_data = get_json_data_from_file(json_path)
    elif mode == "api":
        json_data = get_json_data_from_api()
    else:
        raise Exception("Mode {mode} not supported".format(mode = mode))
    
    categories = get_categories(json_data)
    version = json_data.get("Version") 
    
    return categories, json_data, version

def get_json_data_from_file(json_path):
    f = open(json_path)
    json_data = json.load(f)
    return json_data
    
def get_json_data_from_api():
    version = "02.04.000"
    lng = language if language else "en"
    format = "json"

    url = "https://api.boverket.se/klimatdatabas/get-all-resources/{version}/{language}/{format}".format(
        version=version, language=lng, format=format)
    
    request = WebRequest.Create(url)
    
    request.Method = "GET"
    request.Timeout = 5000
    #request.ContentType = "application/json"
    response = request.GetResponse()
    
    stream_reader = StreamReader(response.GetResponseStream())
    json_data = json.loads(stream_reader.ReadToEnd())
    return json_data
    
def get_categories(json_data):
    categories = []
    try:
        for metaCategory in json_data['Categories']:
            for cat in metaCategory["Children"]:
                categories.append(cat["Title"])
    except KeyError:
        raise Exception("Format of JSON data is not supported.")
    return categories

if __name__ == "__main__":
    if not scriptcontext.sticky["brimstone_flying"]:
        raise Exception("The 'Brimstone - Fly' component needs to exist on the canvas")
    categories, json_data, klimatdatabas_version = main(mode, json_path)
    json_data = [json_data] # need to put it in an array so GH understands it as a dictionary
# ---------- end get_categories ----------

fly = Brimstone0Fly()
# ---------- fly: Python ----------
"""This component sets up global information for Brimstone
    Inputs:
    Output:
        """

import scriptcontext

scriptcontext.sticky["brimstone_version"] = '0.1.3'
scriptcontext.sticky["brimstone_flying"] = 'true'
scriptcontext.sticky["brimstone_kdb_hb_json"] = 'brimstone_data/230721klimatdatabas_hb_materials.json' # json which adds honeybee material info to klimatdatabas materials
scriptcontext.sticky["brimstone_hb_kdb_csv"] = 'brimstone_data/230728_HBKlimatdatabas.csv' # csv file which translates honeybee material names to klimatdatabas material names
ghenv.Component.Message = scriptcontext.sticky["brimstone_version"]
# ---------- end fly ----------
honeybee_model_2 = Data(honeybee_model)
calculate_honeybee_model = Brimstone5CalculateEmbodiedCarbonOfHoneybeeModel(hb_model=honeybee_model_2, kdb_json_data=get_categories.json_data)  # -> tot_emb_carbon, elements, el_emb_carbon
# ---------- calculate_honeybee_model: Python ----------
"""
Calculates embodied carbon for the elements of a Honeybee model if data is available
This component was inspired by the 'HB Color Face Attributes' component of Ladybug Tools 1.6.0

    Args:
        hb_model: Honeybee model for analysis
        kdb_json_data: Optional json data object for materials which do not include impact data

    Returns:
        tot_emb_carbon: total embodied carbon of model
        elements: element types in the model
        el_emb_carbon: embodied carbon for each element type in the model
"""

import scriptcontext
import Grasshopper
from Grasshopper.Kernel import GH_RuntimeMessageLevel as Message
import os
import csv, codecs

ghenv.Component.Name = 'Brimstone - 5. Calculate Embodied Carbon of Honeybee Model'
ghenv.Component.NickName = 'Calculate Honeybee Model'

try:  # import the core honeybee dependencies
    from honeybee.model import Model
    from honeybee.properties import FaceProperties
    from honeybee.typing import clean_ep_string
except ImportError as e:
    raise ImportError('\nFailed to import honeybee:\n\t{}'.format(e))
    

# todo: magic string here - not good!
gwp_data_string = "Global Warming potential"
gwp_data_points = [
    "A1-A3 Conservative",
    "A4",
    "A5.1",
]

def main(hb_model):
    tot_emb_carbon = 0
    elements = []
    el_emb_carbon = []
    if not isinstance(hb_model, Model):
        raise Exception("hb_model input must be a valid honeybee model")
    faces = []
    apertures = []
    model_mats = []
    face_types = {}
    
    energy_properties = hb_model.properties.energy
    
    for material in energy_properties.materials:
        model_mats.append(material)
    for room in hb_model.rooms:
        faces.extend(room.faces)
        faces.extend(room.shades)
    faces.extend(hb_model.orphaned_faces)
    faces.extend(hb_model.orphaned_apertures)
    faces.extend(hb_model.orphaned_doors)
    faces.extend(hb_model.orphaned_shades)
    
    for face_obj in faces:
        if isinstance(face_obj.properties, FaceProperties):
            face_area = face_obj.area - face_obj.aperture_area
            face_type = face_obj.type
            
            face_impact = 0
            for lyr in face_obj.properties.energy.construction.layers:
                face_impact += get_face_impact(model_mats, lyr, face_area)
                """
                if lyr not in model_mats:
                    model_mats[lyr] = { area: face_area }
                else:
                    model_mats[lyr].area = model_mats[lyr].area + face_area
                """
                       
            if face_type not in face_types:
                face_types[face_type] = { "impact": face_impact }
            else:
                face_types[face_type]["impact"] += face_impact
                
            
            for aperture in face_obj.apertures:
                aperture_impact = get_aperture_impact(aperture)
                if "Aperture" not in face_types:
                    face_types["Aperture"] = { "impact": aperture_impact }
                else:
                    face_types["Aperture"]["impact"] += aperture_impact
    for face_type in face_types.items():
        face_impact = face_type[1]["impact"]
        tot_emb_carbon += face_impact
        elements.append(face_type[0])
        el_emb_carbon.append(face_impact)
    return tot_emb_carbon, elements, el_emb_carbon

def get_face_impact(materials, layer_name, face_area):
    for material in materials:
        if material.identifier == layer_name:
            abs_impact = 0
            if hasattr(material.properties, "gwp_a1_a3"):
                mp = material_properties
                
                impact = mp.gwp_a1_a3 + mp.gwp_a4 + mp.gwp_a5_1
                abs_impact = material.properties.density*impact
            else:
                abs_impact = get_face_impact_from_material_name(material.identifier)
            return material.thickness*abs_impact*face_area
    warn("The calculation may be faulty as material " + layer_name + " was not found among the energy materials in the model.")
    return 0

# Gets material impact data from a honeybee material by referencing names in .csv file
def get_face_impact_from_material_name(material_name):
    csv_data_file = scriptcontext.sticky["brimstone_hb_kdb_csv"]
    csv_data_file_path = os.path.join(Grasshopper.Folders.UserObjectFolders[0], csv_data_file)
    if not os.path.exists(csv_data_file_path):
        raise Exception("Failed to open csv file, it should reside in [UserComponents folder]/brimstone_data/")
    kdb_name = check_name_in_kdb(material_name)
    if not kdb_name:
        with open(csv_data_file_path, 'r') as csv_file:
            file_reader = csv.DictReader(csv_file, delimiter=",")
            for row in file_reader:
                if row["HB Name"] == material_name:
                    kdb_name = clean_ep_string(row["Klimatdatabas name"])
                    if not kdb_name or kdb_name == "missing":
                        warn("The calculation may be faulty as impact data is missing for some of the materials in the model: " + material_name)
                        return 0
                    break
    if not kdb_name:
        warn("The calculation may be faulty as material " + material_name + " could not be matched to any material in the brimstone material database.")
        return 0
    
    return get_impact_from_json_data(kdb_name)

def check_name_in_kdb(material_name):
    if not kdb_json_data:
        warn("The calculation may be faulty as kdb_json_data is missing")
    else: 
        for resource in kdb_json_data["Resources"]:
            if clean_ep_string(resource["Name"]) == material_name:
                return material_name
    return ""
    
# TODO: currently only works for KDB windows
def get_aperture_impact(aperture):
    if not len(aperture.properties.energy.construction.layers) == 1:
        warn("The calculation may be faulty as only one layer window constructions can be calculated.")
        return 0
    
    window_material = aperture.properties.energy.construction.layers[0]
    return get_impact_from_json_data(window_material)*aperture.area

def get_impact_from_json_data(kdb_name):
    if not kdb_json_data:
        warn("The calculation may be faulty as kdb_json_data is missing")
        return 0
    for resource in kdb_json_data["Resources"]:
        if clean_ep_string(resource["Name"]) == kdb_name:
            conv = resource["Conversions"][0]["Value"]
            
            for data_item in resource["DataItems"]:
                if data_item["PropertyName"] == gwp_data_string:
                    abs_impact = 0
                    for data_pt in gwp_data_points:
                        for data_val_item in data_item["DataValueItems"]:
                            if data_val_item["DataModuleCode"] == data_pt:
                                abs_impact += data_val_item["Value"]
                    return abs_impact*conv
            warn("The calculation may be faulty as material " + kdb_name + " has no GWP data in kdb_json_data")
            return 0
    warn("The calculation may be faulty as material " + kdb_name + " was not found in kdb_json_data")
    return 0
    
def warn(message):
    ghenv.Component.AddRuntimeMessage(Message.Warning, message)

if __name__ == "__main__":
    try:
        flying = scriptcontext.sticky["brimstone_flying"]
    except:
        raise Exception("The 'Brimstone - Fly' component needs to exist on the canvas")
    ver = scriptcontext.sticky["brimstone_version"]
    ghenv.Component.Message = ver
    tot_emb_carbon, elements, el_emb_carbon = main(hb_model)
# ---------- end calculate_honeybee_model ----------
total_gwp = Data(calculate_honeybee_model.tot_emb_carbon)
element_types = Data(calculate_honeybee_model.elements)
gwp_by_element_type = Data(calculate_honeybee_model.el_emb_carbon)
gwp_by_element_type_2 = ClusterOutput(gwp_by_element_type)
element_types_2 = ClusterOutput(element_types)
total_gwp_2 = ClusterOutput(total_gwp)

# ==== cluster Cluster_2
legendpar = LBLegendParameters(min=Slider(0, range=0..100), max=Slider(100, range=0..100), num_decimals=Slider(0, range=0..100))  # -> leg_par; plug-in component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
leg_par = ClusterOutput(legendpar)

# ==== cluster Cluster_3
min = ClusterInput()
max = ClusterInput()
colors = ClusterInput()
legendpar = LBLegendParameters(min=min, max=max, colors=colors)  # -> leg_par; plug-in component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
leg_par = ClusterOutput(legendpar)
