# Grasshopper definition DTCC_WindComforParser.gh (Grasshopper 1.0.7)
# Copyright: SS
# plug-ins: CockroachGH, Bifocals

# Select wind file here
path = FilePath("C:\Users\ssanjay\Downloads\WindComfort_option_0.csv")
path_2 = FilePath("C:\Users\ssanjay\Downloads\Windcomfort_option_6.csv")
find_max_and_min3 = GhPythonScript(File=path_2)  # -> out, low, high, c
# ---------- find_max_and_min3: Python ----------
__author__ = "ssanjay"
__version__ = "2022.12.01"

import rhinoscriptsyntax as rs
import csv

c = []
with open(File) as csvfile:
    reader = csv.reader(csvfile)
    next(reader)
    for row in reader:
        val = float(row[0])
        c.append(val)
high = max(c)
low = min(c)
# ---------- end find_max_and_min3 ----------
coords = ImportCoordinates(File=path_2, Separator=",", XIndex="1", YIndex="2", ZIndex="3")
cull_i = CullIndex(List=coords, Indices="0", Wrap=True)
pt = ConstructPoint(XCoordinate=0, YCoordinate=0, ZCoordinate=find_max_and_min3.c)
gradient = Gradient(
    LowerLimit=find_max_and_min3.low,
    UpperLimit=find_max_and_min3.high,
    Parameter=find_max_and_min3.c,
    stops=[0: RGB(12, 7, 134), 0.0312: RGB(33, 5, 143), 0.0625: RGB(49, 4, 150), 0.0938: RGB(63, 3, 156), 0.125: RGB(76, 2, 161), 0.156: RGB(89, 1, 164)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])
voxelsize = Slider(2, range=0..10)
create = CloudCreate(Points=cull_i, Normals=pt, Colors=gradient)
downsamplevoxel = DownsampleVoxel(PointCloud=create, VoxeSize=voxelsize)
explode = CloudExplode(PointCloud=downsamplevoxel)  # -> Points, Normals, Colors
del = DelaunayMesh(Points=explode.Points, Plane=PlaneXY(0, 0, 0))
mcol = MeshColours(Mesh=del, Colours=explode.Colors)
move_to_location = Panel("319949, 6398000, 5")
merge = Merge(
    Data1=ColourSwatch(SwatchColor=RGB(9, 16, 222)),
    Data2=ColourSwatch(SwatchColor=RGB(3, 169, 252)),
    Data3=ColourSwatch(SwatchColor=RGB(171, 255, 254)),
    Data4=ColourSwatch(SwatchColor=RGB(85, 255, 0)),
    Data5=ColourSwatch(SwatchColor=RGB(255, 255, 0)),
    Data6=ColourSwatch(SwatchColor=RGB(255, 85, 0)))
legendpar = LBLegendParameters(max=Slider(5, range=0..10), colors=merge)  # -> leg_par; plug-in component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
pdecon = Deconstruct(Point=explode.Normals)  # -> XComponent, YComponent, ZComponent
move = Move(Geometry=explode.Points, Motion=move_to_location)  # -> Geometry, Transform
move_2 = Move(Geometry=mcol, Motion=move_to_location)  # -> Geometry, Transform
heatmap = LBSpatialHeatmap(values=pdecon.ZComponent, mesh=move_2.Geometry, legend_par=legendpar, legend_title="Lawson LDDC")  # -> mesh, legend, title, colors, legend_par, vis_set; plug-in component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
cloud = CloudDisplay(Points=move.Geometry, Colours=heatmap.colors, Size=Slider(0.8, range=0..1), SpriteType=1)
