# Grasshopper definition 230502_Wallacei_packages.gh (Grasshopper 1.0.7)
# Copyright: SS
# plug-ins: LadybugGrasshopper, Octopus, CORE.Grasshopper.Colibri

wall_height = Slider(2.5, range=0..10)
window_height = Slider(1, range=0..1)
# INPUT GEOMETRY
#        From Rhino
geometry_pipeline = GeometryPipeline(
    GroupByLayer=False,
    GroupByType=False,
    IncludeHidden=True,
    IncludeLocked=True,
    LayerFilter="zone 01",
    NameFilter="*",
    SublayerFiltering=True,
    TypeFilter=4)
geometry_pipeline_2 = GeometryPipeline(
    GroupByLayer=False,
    GroupByType=False,
    IncludeHidden=True,
    IncludeLocked=True,
    LayerFilter="zone 02",
    NameFilter="*",
    SublayerFiltering=True,
    TypeFilter=4)
geometry_pipeline_3 = GeometryPipeline(
    GroupByLayer=False,
    GroupByType=False,
    IncludeHidden=True,
    IncludeLocked=True,
    LayerFilter="Windows",
    NameFilter="*",
    SublayerFiltering=True,
    TypeFilter=4)
unit_z = UnitZ(Factor=wall_height)
unit_z_2 = UnitZ(Factor=wall_height)
unit_z_3 = UnitZ(Factor=window_height)
extrude = Extrude(Base=geometry_pipeline, Direction=unit_z)
extrude_2 = Extrude(Base=geometry_pipeline_2, Direction=unit_z_2)
extrude_3 = Extrude(Base=geometry_pipeline_3, Direction=unit_z_3)
unit_z_4 = UnitZ(Factor="0.4")
cap_holes = CapHoles(Brep=extrude)
cap_holes_2 = CapHoles(Brep=extrude_2)
move = Move(Geometry=extrude_3, Motion=unit_z_4)  # -> Geometry, Transform

opaquemat = HBOpaqueMaterial(name="Concrete_HW", thickness="0.2", conductivity="2.25", density="2400", spec_heat="1050")  # -> mat; plug-in component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
opaquemat_2 = HBOpaqueMaterial(name="Insulation_regular_wall", thickness="0.1", conductivity="0.035", density="100", spec_heat="840")  # -> mat; plug-in component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
opaquemat_3 = HBOpaqueMaterial(name="gypsum board", thickness="0.2", conductivity="0.18", density="800", spec_heat="950")  # -> mat; plug-in component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
opaquemat_4 = HBOpaqueMaterial(name="Insulation_regular_roof", thickness="0.4", conductivity="0.035", density="100", spec_heat="840")  # -> mat; plug-in component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
windowmat = HBWindowMaterial(name="Existing Window U-value = 2.4", u_factor="2.4", shgc="0.5")  # -> mat; plug-in component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
merge = Merge(Data1=opaquemat_3, Data2=opaquemat_4)  # -> flatten(Result)
merge_2 = Merge(Data1=opaquemat, Data2=opaquemat_2)  # -> flatten(Result)
opaqueconstr = HBOpaqueConstruction(name="Ext_Wall", materials=merge_2)  # -> constr; plug-in component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
windowconstr = HBWindowConstruction(name="Windows", materials=windowmat)  # -> constr; plug-in component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

# ----
# FILE INPUT
# EPW file path
# Material database
# Construction database
# Colibri slider
panel = Panel("Z:\Urban_energy_models\Uddevalla2017EPWv2.epw")
solution_number = Slider(239, range=0..239)
file_path = FilePath("Z:\Urban_energy_models\Material_database\construction_DB.csv")
file_path_2 = FilePath("Z:\Urban_energy_models\Material_database\mat_DB4.csv")

# ----
# Add existing building materials
opaquemat_5 = HBOpaqueMaterial(name="Concrete", thickness="0.20", conductivity="2.25", density="2400", spec_heat="1050")  # -> mat; plug-in component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
merge_3 = Merge(Data1=opaquemat_5)  # -> flatten(Result)
opaqueconstr_2 = HBOpaqueConstruction(name="Roof", materials=merge)  # -> constr; plug-in component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
opaqueconstr_3 = HBOpaqueConstruction(name="Floor", materials=merge_3)  # -> constr; plug-in component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
ghpython_script = GhPythonScript(
    base_Wall=opaqueconstr,
    base_Floor=opaqueconstr_3,
    base_Roof=opaqueconstr_2,
    base_Window=windowconstr,
    mat_DB=file_path_2,
    cons_DB=file_path)  # -> out, HB_Walls, HB_Floors, HB_Roofs, HB_Windows
# ---------- ghpython_script: Python ----------
import csv
import json
from honeybee_energy.material.opaque import EnergyMaterial
from honeybee_energy.construction.opaque import OpaqueConstruction
from honeybee_energy.lib.materials import opaque_material_by_identifier
from honeybee_energy.material.glazing import EnergyWindowMaterialSimpleGlazSys
from honeybee_energy.construction.window import WindowConstruction
from honeybee_energy.lib.materials import window_material_by_identifier
from honeybee.typing import clean_and_id_ep_string, clean_ep_string

try:  # import the core honeybee dependencies
    from honeybee.typing import clean_and_id_ep_string, clean_ep_string
except ImportError as e:
    raise ImportError('\nFailed to import honeybee:\n\t{}'.format(e))

try:  # import the honeybee-energy dependencies
    from honeybee_energy.construction.opaque import OpaqueConstruction
    from honeybee_energy.lib.materials import opaque_material_by_identifier
except ImportError as e:
    raise ImportError('\nFailed to import honeybee_energy:\n\t{}'.format(e))

try:  # import ladybug_rhino dependencies
    from ladybug_rhino.grasshopper import all_required_inputs
except ImportError as e:
    raise ImportError('\nFailed to import ladybug_rhino:\n\t{}'.format(e))


def read_csv_file(file_path):
    with open(file_path, 'rb') as csvfile:
        reader = csv.DictReader(csvfile.read().decode('utf-8-sig').splitlines())
        data = [row for row in reader]
    return data

def process_mat_data(mat_data):
    result = {row['UUID']: row for row in mat_data}
    return result

def process_cons_data(cons_data):
    result = {}
    for row in cons_data:
        element = row['Element']
        identifier = row['Identifier']
        layer_id = row['Layer']
        uuid = row['UUID']
        cons = element + '_' + identifier

        if cons not in result:
            result[cons] = {
                'Element': element,
                'Identifier': identifier,
                'Layer': []
            }

        result[cons]['Layer'].append({
            'layer_id': layer_id,
            'UUID': uuid
        })

    return result

mat_data = read_csv_file(mat_DB)
cons_data = read_csv_file(cons_DB)

mat_data = process_mat_data(mat_data)
cons_data = process_cons_data(cons_data)
cons_data = {k.replace('_', ' '): v for k, v in cons_data.items()}

#from honeybee_energy.lib.constructions import opaque_construction_by_identifier
#base_Wall = opaque_construction_by_identifier(base_Wall)
#base_Floor = opaque_construction_by_identifier(base_Floor)
#base_Roof = opaque_construction_by_identifier(base_Roof)
#from honeybee_energy.lib.constructions import window_construction_by_identifier
#base_Window = window_construction_by_identifier(base_Window)

HB_Walls = [base_Wall]
HB_Floors = [base_Floor]
HB_Roofs = [base_Roof]
HB_Windows = [base_Window]


for construction in cons_data:
    if 'Wall' in construction:
        _materials = list(base_Wall.materials)
        for layer_info in cons_data[construction]['Layer']:
            layer = mat_data[layer_info['UUID']]
            _name_ = layer['Material']
            name = clean_and_id_ep_string('OpaqueMaterial') if _name_ is None else \
                clean_ep_string(_name_)
            mat = EnergyMaterial(
                name,
                float(layer['Thickness']),
                float(layer['Conductivity']),
                float(layer['Density']),
                950,  # _spec_heat
                'MediumRough',  # _roughness_
                0.9,  # _therm_absp_
                0.7,  # _sol_absp_
                0.9  # _vis_absp_
            )
            _materials.append(mat)
        material_objs = [opaque_material_by_identifier(mat) if isinstance(mat, str) else mat for mat in _materials]
        print construction
        name = clean_and_id_ep_string('OpaqueConstruction') if construction is None else \
            clean_ep_string(construction)
        print name
        constr = OpaqueConstruction(name, material_objs)
        constr.display_name = construction
        HB_Walls.append(constr)


    if 'Floor' in construction:
        _materials = list(base_Floor.materials)
        for layer_info in cons_data[construction]['Layer']:
            layer = mat_data[layer_info['UUID']]
            mat = EnergyMaterial(
                layer['Material'],
                float(layer['Thickness']),
                float(layer['Conductivity']),
                float(layer['Density']),
                950,  # _spec_heat
                'MediumRough',  # _roughness_
                0.9,  # _therm_absp_
                0.7,  # _sol_absp_
                0.9  # _vis_absp_
            )
            _materials.append(mat)
        material_objs = [opaque_material_by_identifier(mat) if isinstance(mat, str) else mat for mat in _materials]
        constr = OpaqueConstruction(construction, material_objs)
        HB_Floors.append(constr)

    if 'Roof' in construction:
        _materials = list(base_Roof.materials)
        for layer_info in cons_data[construction]['Layer']:
            layer = mat_data[layer_info['UUID']]
            mat = EnergyMaterial(
                layer['Material'],
                float(layer['Thickness']),
                float(layer['Conductivity']),
                float(layer['Density']),
                950,  # _spec_heat
                'MediumRough',  # _roughness_
                0.9,  # _therm_absp_
                0.7,  # _sol_absp_
                0.9  # _vis_absp_
            )
            _materials.append(mat)
        material_objs = [opaque_material_by_identifier(mat) if isinstance(mat, str) else mat for mat in _materials]
        constr = OpaqueConstruction(construction, material_objs)
        HB_Roofs.append(constr)


    if 'Window' in construction:
        _materials = []
        for layer_info in cons_data[construction]['Layer']:
            layer = mat_data[layer_info['UUID']]
            mat = EnergyWindowMaterialSimpleGlazSys(
                layer['Material'],
                float(layer['U-value']),
                0.3,    #shgc
                0.6     #t_vis
            )
            _materials.append(mat)
        material_objs = [window_material_by_identifier(mat) if isinstance(mat, str) else mat for mat in _materials]
        constr = WindowConstruction(construction, material_objs)
        HB_Windows.append(constr)
# ---------- end ghpython_script ----------
ghpython_script_2 = GhPythonScript(
    HB_Walls=ghpython_script.HB_Walls,
    HB_Floors=ghpython_script.HB_Floors,
    HB_Roofs=ghpython_script.HB_Roofs,
    HB_Windows=ghpython_script.HB_Windows)  # -> out, list_combinations; inputs HB_Walls: list, HB_Floors: list, HB_Roofs: list, HB_Windows: list
# ---------- ghpython_script_2: Python ----------
import itertools
import ghpythonlib.treehelpers as th

#all_combinations = list(itertools.product(HB_Walls, HB_Floors, HB_Roofs)) 

all_combinations = list(itertools.product(HB_Walls, HB_Floors, HB_Roofs, HB_Windows)) 
list_combinations = []
for t in all_combinations:
    list_combinations.append(list(t))

list_combinations = th.list_to_tree(list_combinations)
# ---------- end ghpython_script_2 ----------
crossref = CrossReference(
    ListA=ghpython_script.HB_Walls,
    ListB=ghpython_script.HB_Floors,
    ListC=ghpython_script.HB_Roofs,
    ListD=ghpython_script.HB_Windows,
    CrossMode=1)  # -> ListA, ListB, ListC, ListD
merge_4 = Merge(Data1=graft(crossref.ListA), Data2=graft(crossref.ListB), Data3=graft(crossref.ListC), Data4=graft(crossref.ListD))
flip_matrix = FlipMatrix(Data=merge_4)
panel_2 = Panel(merge_4)
list_item = ListItem(List=flip_matrix, Index=solution_number, Wrap=True)
explode_tree = ExplodeTree(Data=list_item)  # -> Branch0, Branch1, Branch2, Branch3
panel_3 = Panel(explode_tree.Branch0)
panel_4 = Panel(explode_tree.Branch1)
panel_5 = Panel(explode_tree.Branch2)
panel_6 = Panel(explode_tree.Branch3)
exteriorsubset = HBExteriorConstructionSubset(exterior_wall=explode_tree.Branch0, exterior_roof=explode_tree.Branch2)  # -> exterior_set; plug-in component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
groundsubset = HBGroundConstructionSubset(ground_floor=explode_tree.Branch1)  # -> ground_set; plug-in component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
panel_7 = Panel(flip_matrix)
constructionset = HBConstructionSet(exterior_subset=exteriorsubset, ground_subset=groundsubset)  # -> constr_set; plug-in component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
decnstrconstr = HBDeconstructConstruction(constr=explode_tree.Branch0)  # -> materials, layers, r_val_si, r_val_ip, u_fac_si, u_fac_ip, shgc, t_sol, t_vis; plug-in component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
decnstrmat = HBDeconstructMaterial(mat=decnstrconstr.materials)  # -> values, attr_names, r_val_si, r_val_ip; plug-in component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
decnstrconstrset = HBDeconstructConstructionSet(constr_set=constructionset)  # -> exterior_wall, exterior_roof, exposed_floor, ground_wall, ground_roof, ground_floor, window, skylight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; plug-in component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
panel_8 = Panel(decnstrmat.values)
split = TextSplit(
    Text=[decnstrconstrset.exterior_wall, decnstrconstrset.ground_floor, decnstrconstrset.exterior_roof, explode_tree.Branch3],
    Separators=",")  # -> simplify(Result)
item = ListItem(List=split, Index="1", Wrap=True)
split_2 = TextSplit(Text=item)  # -> simplify(Result)
item_2 = ListItem(List=split_2, Index="1", Wrap=True)
panel_9 = Panel(item_2)

hb_building_vintages = HBBuildingVintages({"ASHRAE 90.1 2013  |  IECC 2015": "2013", "ASHRAE 90.1 2010  |  IECC 2012": "2010", "ASHRAE 90.1 2007  |  IECC 2009": "2007", "ASHRAE 90.1 2004  |  IECC 2006": "2004", "1980-2004 (CBECS)": "1980_2004", "Pre-1980 (CBECS)": "pre_1980"}, selected="ASHRAE 90.1 2013  |  IECC 2015")
hb_building_programs = HBBuildingPrograms({"LargeOffice", "MediumOffice", "SmallOffice", "MidriseApartment", "HighriseApartment", "Retail", "StripMall", "PrimarySchool", "SecondarySchool", "SmallHotel", "LargeHotel", "Hospital", "Outpatient", "Laboratory", "Warehouse", "SuperMarket", "FullServiceRestaurant", "QuickServiceRestaurant", "Courthouse", "LargeDataCenterHighITE", "LargeDataCenterLowITE", "SmallDataCenterHighITE", "SmallDataCenterLowITE"}, selected="MidriseApartment")
searchprog = HBSearchPrograms(bldg_prog=hb_building_programs, vintage=hb_building_vintages, keywords="apartment")  # -> room_prog; plug-in component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
deconstrprogram = HBDeconstructProgramType(program=searchprog)  # -> people, lighting, electric_equip, gas_equip, hot_water, infiltration, ventilation, setpoint; plug-in component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
# Properties of building
panel_10 = Panel(deconstrprogram.people)
panel_11 = Panel(deconstrprogram.electric_equip)
panel_12 = Panel(deconstrprogram.setpoint)
decnstrequipment = HBDeconstructEquipment(equip=deconstrprogram.electric_equip)  # -> name, watts_per_area, schedule, radiant_fract, latent_fract, lost_fract, is_gas; plug-in component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
decnstrsetpoint = HBDeconstructSetpoint(setpoint=deconstrprogram.setpoint)  # -> name, heating_sch, cooling_sch, humid_setpt, dehumid_setpt; plug-in component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
panel_13 = Panel([decnstrequipment.name, decnstrequipment.watts_per_area, decnstrequipment.schedule, decnstrequipment.radiant_fract, decnstrequipment.latent_fract, decnstrequipment.lost_fract, decnstrequipment.is_gas])
equipment = HBEquipment(
    name="CustomEquipment",
    watts_per_area="3.424071221",
    schedule=decnstrequipment.schedule,
    radiant_fract=decnstrequipment.radiant_fract,
    latent_fract=decnstrequipment.latent_fract,
    lost_fract=decnstrequipment.lost_fract,
    gas=decnstrequipment.is_gas)  # -> equip; plug-in component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
infiltration = HBInfiltration(name="infiltration_Current", flow_per_ext_area="0.00056")  # -> infil; plug-in component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
ventilation = HBVentilation(name="minimum ventilation", ach="0.5")  # -> vent; plug-in component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
programtype = HBProgramType(
    name="zone 01 program",
    base_program=searchprog,
    electric_equip=equipment,
    infiltration=infiltration,
    ventilation=ventilation)  # -> program; plug-in component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
infiltration_2 = HBInfiltration(name="infiltration_Current", flow_per_ext_area="0.00056")  # -> infil; plug-in component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
ventilation_2 = HBVentilation(name="minimum ventilation", ach="0.5")  # -> vent; plug-in component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
programtype_2 = HBProgramType(
    name="zone 02 program",
    base_program=searchprog,
    electric_equip=equipment,
    infiltration=infiltration_2,
    ventilation=ventilation_2)  # -> program; plug-in component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

# ----
# Implemeting properties to building
entwine = Entwine(Branch00=cap_holes, Branch01=cap_holes_2, FlattenInputs=True)
boolean_toggle = BooleanToggle(True)
intsolid = HBIntersectSolids(solids=flatten(entwine), parallel=boolean_toggle, run=boolean_toggle)  # -> int_solids; plug-in component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
unflatten_tree = UnflattenTree(Tree=intsolid, Guide=entwine)
explode_tree_2 = ExplodeTree(Data=unflatten_tree)  # -> Branch0, Branch1
roomsolid = HBRoomFromSolid(geo=flatten(explode_tree_2.Branch0), name="zone 01", program=programtype, conditioned=True)  # -> report, rooms; plug-in component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
roomsolid_2 = HBRoomFromSolid(geo=flatten(explode_tree_2.Branch1), name="zone 02", program=programtype_2, conditioned=True)  # -> report, rooms; plug-in component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

decnstrconstrset_2 = HBDeconstructConstructionSet(constr_set=constructionset)  # -> exterior_wall, exterior_roof, exposed_floor, ground_wall, ground_roof, ground_floor, window, skylight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; plug-in component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
decnstrconstr_2 = HBDeconstructConstruction(constr=decnstrconstrset_2.exterior_wall)  # -> materials, layers, r_val_si, r_val_ip, u_fac_si, u_fac_ip, shgc, t_sol, t_vis; plug-in component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
decnstrconstr_3 = HBDeconstructConstruction(constr=decnstrconstrset_2.exterior_roof)  # -> materials, layers, r_val_si, r_val_ip, u_fac_si, u_fac_ip, shgc, t_sol, t_vis; plug-in component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
decnstrconstr_4 = HBDeconstructConstruction(constr=decnstrconstrset_2.ground_floor)  # -> materials, layers, r_val_si, r_val_ip, u_fac_si, u_fac_ip, shgc, t_sol, t_vis; plug-in component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
decnstrconstr_5 = HBDeconstructConstruction(constr=explode_tree.Branch3)  # -> materials, layers, r_val_si, r_val_ip, u_fac_si, u_fac_ip, shgc, t_sol, t_vis; plug-in component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
decnstrmat_2 = HBDeconstructMaterial(mat=decnstrconstr_2.materials)  # -> values, attr_names, r_val_si, r_val_ip; plug-in component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
decnstrmat_3 = HBDeconstructMaterial(mat=decnstrconstr_3.materials)  # -> values, attr_names, r_val_si, r_val_ip; plug-in component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
decnstrmat_4 = HBDeconstructMaterial(mat=decnstrconstr_4.materials)  # -> values, attr_names, r_val_si, r_val_ip; plug-in component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
decnstrmat_5 = HBDeconstructMaterial(mat=decnstrconstr_5.materials)  # -> values, attr_names, r_val_si, r_val_ip; plug-in component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
item_3 = ListItem(List=decnstrmat_2.values, Index=0, Wrap=True)
item_4 = ListItem(List=decnstrmat_3.values, Index=0, Wrap=True)
item_5 = ListItem(List=decnstrmat_4.values, Index=0, Wrap=True)
item_6 = ListItem(List=decnstrmat_5.values, Index=0, Wrap=True)
entwine_2 = Entwine(Branch00=item_3, Branch01=item_4, Branch02=item_5, Branch03=item_6, FlattenInputs=True)
file = ReadFile(File=file_path_2, PerLineParse=True)
panel_14 = Panel(entwine_2)
split_3 = TextSplit(Text=file, Separators=",")
item_7 = ListItem(List=split_3, Index="4", Wrap=True)  # -> flatten(Item)
panel_15 = Panel(item_7)
item_8 = ListItem(List=split_3, Index=1, Wrap=True)
# Write to excel
panel_16 = Panel(item_8)
mindex = MemberIndex(Set=flatten(item_8), Member=entwine_2)  # -> Index, Count
item_9 = ListItem(List=split_3, Index="5", Wrap=True)  # -> flatten(Item)
mindex_2 = MemberIndex(Set=flatten(item_8), Member=entwine_2)  # -> Index, Count
item_10 = ListItem(List=item_7, Index=mindex.Index, Wrap=True)  # -> simplify(Item)
trim = TrimTree(Tree=item_10, Depth=1)
item_11 = ListItem(List=item_9, Index=mindex_2.Index, Wrap=True)  # -> simplify(Item)
clean = CleanTree(RemoveNulls=True, RemoveInvalid=True, RemoveEmpty=True, Tree=trim)
panel_17 = Panel(clean)
trim_2 = TrimTree(Tree=item_11, Depth=1)
clean_2 = CleanTree(RemoveNulls=True, RemoveInvalid=True, RemoveEmpty=True, Tree=trim_2)
branch = TreeBranch(Tree=clean, Path="0", MaintainPaths=True)
branch_2 = TreeBranch(Tree=clean, Path="1", MaintainPaths=True)
branch_3 = TreeBranch(Tree=clean, Path="2", MaintainPaths=True)
branch_4 = TreeBranch(Tree=clean, Path="3", MaintainPaths=True)
branch_5 = TreeBranch(Tree=clean_2, Path="0", MaintainPaths=True)
branch_6 = TreeBranch(Tree=clean_2, Path="1", MaintainPaths=True)
branch_7 = TreeBranch(Tree=clean_2, Path="2", MaintainPaths=True)
branch_8 = TreeBranch(Tree=clean_2, Path="3", MaintainPaths=True)

octopus = Octopus(OctopusData_gene=solution_number, OctopusData_obj=[heating_kwh_m2, lcc_sek_m2])
bang = ExplodeTree(Data=item_2)  # -> Branch0, Branch1, Branch2, Branch3

applyconstrset = HBApplyConstructionSet(rooms=roomsolid.rooms, constr_set=constructionset)  # -> rooms; plug-in component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
applyconstrset_2 = HBApplyConstructionSet(rooms=roomsolid_2.rooms, constr_set=constructionset)  # -> rooms; plug-in component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
idealair = HBIdealAir(rooms=flatten(applyconstrset_2))  # -> out, rooms; plug-in component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
panel_18 = Panel(applyconstrset)
idealair_2 = HBIdealAir(rooms=flatten(applyconstrset))  # -> out, rooms; plug-in component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
panel_19 = Panel(applyconstrset_2)
applysetpointvals = HBApplySetpointValues(room_or_program=flatten(idealair_2.rooms), heating_setpt="21")  # -> out, mod_obj; plug-in component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
applysetpointvals_2 = HBApplySetpointValues(room_or_program=flatten(idealair.rooms), heating_setpt="0")  # -> out, mod_obj; plug-in component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
panel_20 = Panel(applysetpointvals.out)
vector_xyz = VectorXYZ(XComponent=0, YComponent=0, ZComponent=wall_height)  # -> Vector, Length
solveadj = HBSolveAdjacency(rooms=flatten([applysetpointvals_2.mod_obj, applysetpointvals.mod_obj]), run=Toggle(True))  # -> out, adj_rooms; plug-in component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
aperture = HBAperture(geo=move.Geometry, name="Windows_Orignial", ep_constr=explode_tree.Branch3)  # -> out, apertures; plug-in component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
addsubface = HBAddSubface(hb_obj=flatten(solveadj.adj_rooms), sub_faces=flatten(aperture.apertures))  # -> hb_obj; plug-in component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

# ----
# Option2: Model Each of the Stories as Detailed Geometry
series = Series(Start=0, Step=1, Count="3")
# Construct geometry
multiplication = Multiplication(A=vector_xyz.Vector, B=series)
concat = Concatenate(FragmentA="Story", FragmentB=series)  # -> simplify(graft(Result))

concatenate = Concatenate(FragmentA=series, FragmentB="_floor")
move_2 = HBMove(hb_objs=flatten(addsubface), vector=multiplication, prefix=concatenate)  # -> hb_objs; plug-in component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
setstory = HBSetStory(rooms=move_2, story=concat)  # -> out, rooms; plug-in component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

solveadj_2 = HBSolveAdjacency(rooms=flatten(setstory.rooms), run=Toggle(True))  # -> report, adj_rooms; plug-in component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

# ---- group: Visualize Stories
roomattr = HBRoomAttributes({"Display Name": "display_name", "Simulation Name (Identifier)": "identifier", "Multiplier": "multiplier", "Story": "story", "Volume": "volume", "Gross Floor Area": "floor_area", "Exposed Area": "exposed_area", "Exterior Wall Area": "exterior_wall_area", "Exterior Aperture Area": "exterior_aperture_area", "Average Floor Elevation": "average_floor_height"}, selected="Story")
colorroomattr = HBColorRoomAttributes(rooms_model=flatten(solveadj_2.adj_rooms), attribute=roomattr)  # -> mesh, legend, wire_frame, values, colors; plug-in component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
vizquick = HBVizualizeQuick(hb_objs=flatten(solveadj_2.adj_rooms))  # -> geo; plug-in component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
preview = CustomPreview(Geometry=vizquick, Material=colorroomattr.colors)

# ---- group: Visualize Boundary Conditions
vizbybc = HBVizualizeByBC(rooms=solveadj_2.adj_rooms)  # -> outdoors, surface, ground, adiabatic, other, wire_frame; plug-in component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
geo = Geometry(vizbybc.adiabatic)
geo_2 = Geometry(vizbybc.surface)
geo_3 = Geometry(vizbybc.wire_frame)

# ----
# Run energy plus
falsestart = LBFalseStartToggle(False)
concatenate_2 = Concatenate(FragmentA="Parametric_sim")
panel_21 = Panel(addsubface)
model = HBModel(rooms=flatten(solveadj_2.adj_rooms), name=concatenate_2)  # -> out, model; plug-in component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
# Perform Energy Plus calculation
modeltoosm = HBModelToOSM(model=model.model, epw_file=panel, write=Toggle(True), run=falsestart)  # -> report, jsons, osw, osm, idf, sql, zsz, rdd, html; plug-in component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
panel_22 = Panel(modeltoosm.jsons)
panel_23 = Panel(modeltoosm.idf)
eui = HBEndUseIntensity(sql=modeltoosm.sql)  # -> eui, eui_end_use, end_uses, gross_floor; plug-in component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
concatenate_3 = Concatenate(Fragment_A=eui.end_uses, A=" : ", Fragment_B=eui.eui_end_use, B=" kWh/m2")
item_12 = ListItem(List=eui.eui_end_use, Index=0, Wrap=True)
heating_kwh_m2 = Number(item_12)
panel_24 = Panel(concatenate_3)

# ----
# Store .idf-files
concat_2 = Concatenate(FragmentH="_", FragmentA=solution_number)
concat_3 = Concatenate(FragmentA="FILE PATH!", FragmentB=concat_2, FragmentC=".idf")
python = GhPythonScript(src=modeltoosm.idf, dst=concat_3)  # -> out, a
# ---------- python: Python ----------
__author__ = "fojacob"
__version__ = "2023.03.09"

import rhinoscriptsyntax as rs
import shutil

shutil.copyfile(src,dst)

a = dst
# ---------- end python ----------
panel_25 = Panel(python.a)

# ----
# LCC operational
price_per_kwh_sek = Panel("0.85")
years = Panel("20")
lcc_repair_calculator = GhPythonScript(
    heating_demand=heating_kwh_m2,
    current_price=price_per_kwh_sek,
    frequency="1",
    lifetime=years,
    inflation_rate="0.02",
    discount_rate="0.05")  # -> out, NPV, reduced_price, yearly_cost; inputs frequency: Int32, lifetime: Int32
# ---------- lcc_repair_calculator: Python ----------
"""Provides a scripting component.
    Inputs:
        heating_demand: Heating demand per square meter for the current year [kWh]
        current_price: Current price of energy [SEK/kWh]
        frequency: Occurence of cost every n years
        lifetime: Lifespan of the building
        inflation_rate: Rate of inflation, percentage factor
        discount_rate: Nominal discount rate, percentage factor
    Output:
        NPV: Net present value of future costs
        reduced_price: Reduced cost of every year
        yearly_cost: Cost occurence every year without reduction factor"""

__author__ = "fojacob"
__version__ = "2023.01.30"

import rhinoscriptsyntax as rs
import math


lt = range(1,lifetime+1)

NPV = []
reduced_price = []
reduction = []
yearly_cost = []

for i in lt:
    red = 1/((1+inflation_rate)**lt[i-1]*(1+discount_rate)**lt[i-1])
    reduction.append(red)
    if i%frequency==0:
        yearly_cost.append(heating_demand*current_price)
    else:
        yearly_cost.append(0)  
    reduced_price.append(yearly_cost[i-1] * reduction[i-1])

NPV = sum(reduced_price)
# ---------- end lcc_repair_calculator ----------
lcc_operation_sek_m2 = Panel(lcc_repair_calculator.NPV)

# ----
# LCA HD
co2_factor = Panel("0.07")
lca_op = Expression(HD=heating_kwh_m2, CO2_fac=co2_factor, RSP=years, Expression="HD * CO2_fac * RSP")
lca_hd = Number(lca_op)
lca_construction_c02e_m2 = Panel(lca_hd)

vizbytype = HBVisualizeByType(hb_objs=model.model)  # -> walls, interior_walls, roofs, ceilings, exterior_floors, interior_floors, air_walls, apertures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; plug-in component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
lng = ListLength(List=geometry_pipeline_3)
area = Area(Geometry=vizbytype.walls)  # -> Area, Centroid
area_2 = Area(Geometry=vizbytype.roofs)  # -> Area, Centroid
area_3 = Area(Geometry=vizbytype.exterior_floors)  # -> Area, Centroid
area_4 = Area(Geometry=vizbytype.apertures)  # -> Area, Centroid
roof = Panel(area_2.Area)
ground_floor = Panel(area_3.Area)
windows = Panel(area_4.Area)
exterior_walls = Panel(area.Area)

area_5 = Area(Geometry=vizbytype.interior_floors)  # -> Area, Centroid
mesh = Mesh(vizbytype.interior_floors)

# ---- group: num of windows
# Areas
num = Number(lng)

# ----
addition = Addition(A=area_3.Area, B=area_5.Area)
bta = Panel(addition)

num_2 = Number(area.Area)
num_3 = Number(area_2.Area)
num_4 = Number(area_3.Area)
num_5 = Number(bta)
num_6 = Number(area_4.Area)

# ----
# LCC Construction
expression = Expression(Price_window=branch_4, A_window=num_6, Expression="Price_window * A_window")
expression_2 = Expression(Price_floor=branch_3, A_floor=num_4, Expression="Price_floor * A_floor")
expression_3 = Expression(Price_roof=branch_2, A_roof=num_3, Expression="Price_roof * A_roof")
expression_4 = Expression(Price_wall=branch, A_wall=num_2, Expression="Price_wall * A_wall")
ma = MassAddition(Input=flatten(expression_4))  # -> Result, PartialResults
ma_2 = MassAddition(Input=flatten(expression_3))  # -> Result, PartialResults
ma_3 = MassAddition(Input=flatten(expression))  # -> Result, PartialResults
ma_4 = MassAddition(Input=flatten(expression_2))  # -> Result, PartialResults
ma_5 = MassAddition(Input=flatten([expression_4, expression_3, expression_2, expression]))  # -> Result, PartialResults
panel_26 = Panel(ma.Result)
panel_27 = Panel(ma_2.Result)
panel_28 = Panel(ma_4.Result)
panel_29 = Panel(ma_3.Result)
division = Division(A=ma_5.Result, B=num_5)
lcc_sek = Number(division)
lcc_investment_sek_m2bta = Panel(lcc_sek)

# ----
# LCA Construction
expression_5 = Expression(EC_window=branch_8, A_window=num_6, Expression="EC_window * A_window")
expression_6 = Expression(EC_floor=branch_7, A_floor=num_4, Expression="EC_floor * A_floor")
expression_7 = Expression(EC_roof=branch_6, A_roof=num_3, Expression="EC_roof * A_roof")
expression_8 = Expression(EC_wall=branch_5, A_wall=num_2, Expression="EC_wall * A_wall")
ma_6 = MassAddition(Input=flatten(expression_8))  # -> Result, PartialResults
ma_7 = MassAddition(Input=flatten(expression_7))  # -> Result, PartialResults
ma_8 = MassAddition(Input=flatten(expression_5))  # -> Result, PartialResults
ma_9 = MassAddition(Input=flatten(expression_6))  # -> Result, PartialResults
ma_10 = MassAddition(Input=flatten([expression_8, expression_7, expression_6, expression_5]))  # -> Result, PartialResults
panel_30 = Panel(ma_6.Result)
panel_31 = Panel(ma_7.Result)
panel_32 = Panel(ma_9.Result)
panel_33 = Panel(ma_8.Result)
division_2 = Division(A=ma_10.Result, B=num_5)
lca_construction = Number(division_2)
lca_construction_c02e_m2_2 = Panel(lca_construction)

addition_2 = Addition(A=lcc_sek, B=lcc_repair_calculator.NPV)
addition_3 = Addition(A=lca_hd, B=lca_construction)
# LCC Total
lcc_sek_m2 = Number(addition_2)
# LCA Total
lca_c02e_m2 = Number(addition_3)

lng_2 = ListLength(List=flip_matrix)  # -> flatten(Length)
item_13 = ListItem(List=lng_2, Index=0, Wrap=True)
# Colibri
subtraction = Subtraction(A=item_13, B=1)
dom = ConstructDomain(DomainStart="0", DomainEnd=subtraction)
falsestart_2 = LBFalseStartToggle(False)
sub_domain = ColibriIterationSubdomain(Domain=dom)
colibri_in = ColibriInputsIterator(R=falsestart_2, S=sub_domain, Solution_number=solution_number, ignoreAllWarningMsg=True)  # -> U, IP, Solution_number, V_N
colibri_out = ColibriOutputs(
    Heating_kWh_m2=flatten(heating_kwh_m2),
    LCA_C02e_m2=flatten(lca_c02e_m2),
    LCC_SEK_m2=flatten(lcc_sek_m2),
    _0_0_0=flatten(bang.Branch0),
    _0_1_0=flatten(bang.Branch1),
    _0_2_0=flatten(bang.Branch2),
    _3_0=flatten(bang.Branch3))
falsestart_3 = LBFalseStartToggle(False)
ca = ColibriAggregator(Folder="Z:\Urban_energy_models\Colibri4", Inputs=colibri_in.IP, Outputs=colibri_out, Write=falsestart_3, recordingMode=0)
