# Grasshopper definition HB_CreateConstructionFromCSV.gh (Grasshopper 1.0.7)
# Copyright: SS

panel = Panel("""Board;Plasterboard;0.02;0.4;32;0.333;760;na
Board;Plastic_sheet_(Polycarbonates);0.02;0.2;900;2.75;800;na
Board;Gypsum_board;0.013;0.21;32;0.333;760;na""")
panel_2 = Panel("""insulation;Mineral_wool;0.1;0.038;23;1.61;300;na
insulation;Polystyrene_with_skin;0.1;0.04;102;4;250;na
insulation;_rock_wool_fasade;0.07;0.02;28;1.61;80;na""")
panel_3 = Panel("""ins 1
ins 2
ins 3""")
panel_4 = Panel("""board 1
board 2
board 3""")
file_path = FilePath("C:\Users\ssanjay\Downloads\221015_material_database.csv")
read_csv = GhPythonScript(path=file_path, run=Toggle(True))  # -> out, mat_out; inputs run: Boolean
# ---------- read_csv: Python ----------
__author__ = "fojacob"
__version__ = "2022.10.14"

import rhinoscriptsyntax as rs
import csv

identifier = []

if run == True:
    #Open the file
    data = open(path)

    #CSV reader
    csv_data = csv.reader(data)

    #Reformat it into a python object List of lists
    data_lines = list(csv_data)

#    identifier = []
#    material = []

    for line in data_lines[0:]:
        identifier.append(line[0])
    #    material.append(line[1])
    

mat_out_ = identifier
#b = material
# ---------- end read_csv ----------
split_materials = GhPythonScript(mat_in=read_csv.mat_out)  # -> insulation, board, window; inputs mat_in: list
# ---------- split_materials: Python ----------
__author__ = "ssanjay"
__version__ = "2022.10.20"

import rhinoscriptsyntax as rs
# Make output list containers
mat,thk,cond,cost,embodied,density,u_value = [],[],[],[],[],[],[]
# Remove the header
mat_in = mat_in[1:]

insulation = []
board = []
window = []


# Searching through all the materials in DB
for mat in mat_in:
    if 'insulation' in mat:
        insulation.append(mat)
    elif 'Board' in mat:
        board.append(mat)
    elif 'window' in mat:
        window.append(mat)
# ---------- end split_materials ----------
list_comprehension = GhPythonScript(insulation=panel_2, board=panel)  # -> out, solution_3, solution_5; inputs insulation: list, board: list
# ---------- list_comprehension: Python ----------
__author__ = "ssanjay"
__version__ = "2022.10.21"

import rhinoscriptsyntax as rs
import itertools
import ghpythonlib.treehelpers as th

solution_3 = [[i, j, k] for i in _board 
                 for j in _insulation
                 for k in _board]
solution_3 = th.list_to_tree(solution_3)

solution_5 = [[i, j, k,l,m] for i in _board 
                 for j in _insulation
                 for k in _board
                 for l in _insulation
                 for m in _board]
solution_5 = th.list_to_tree(solution_5)
# ---------- end list_comprehension ----------
# Turns out itertools performs really bad in comparison to doing a simple list comprehension. Normally this should not be the case outside GHPython. But check out the code, might come in handy at some other time
itertools = GhPythonScript(insulation=split_materials.insulation, board=split_materials.board)  # -> out, sol_3, sol_5; inputs insulation: list, board: list; disabled
# ---------- itertools: Python ----------
__author__ = "ssanjay"
__version__ = "2022.10.21"

import rhinoscriptsyntax as rs
import itertools
import ghpythonlib.treehelpers as th

sol_3 = list(itertools.product(*[_board,_insulation,_board]))
sol_5 = list(itertools.product(*[_board,_insulation,_board,_insulation,_board]))
# ---------- end itertools ----------
list_comprehension_2 = GhPythonScript(insulation=panel_3, board=panel_4)  # -> out, solution_2, solution_4; inputs insulation: list, board: list
# ---------- list_comprehension_2: Python ----------
__author__ = "ssanjay"
__version__ = "2022.10.21"

import rhinoscriptsyntax as rs
import itertools
import ghpythonlib.treehelpers as th

solution_2 = [[i, j] for i in _insulation 
                 for j in _board]


solution_4 = [[i, j, k,l] for i in _insulation 
                 for j in _board
                 for k in _insulation
                 for l in _board]

sol_combined = solution_2+solution_4
solution_2 = th.list_to_tree(solution_2)
solution_4 = th.list_to_tree(solution_4)
sol_combined = th.list_to_tree(sol_combined)
# ---------- end list_comprehension_2 ----------
itertools_2 = GhPythonScript(insulation=panel_3, board=panel_4)  # -> out, sol_2, sol_4; inputs insulation: list, board: list
# ---------- itertools_2: Python ----------
__author__ = "ssanjay"
__version__ = "2022.10.21"

import rhinoscriptsyntax as rs
import itertools
import ghpythonlib.treehelpers as th

sol_2 = list(itertools.product(*[_insulation,_board]))
sol_4 = list(itertools.product(*[_insulation,_board,_insulation,_board]))
# ---------- end itertools_2 ----------
create_solutions = GhPythonScript(insulation=split_materials.insulation, board=split_materials.board)  # -> out, solution_2, solution_4, sol_combined; inputs insulation: list, board: list; same code as list_comprehension_2
make_hb_construction = GhPythonScript(solution=list_comprehension.solution_5)  # -> out, HB_Constructions; inputs solution: tree
# ---------- make_hb_construction: Python ----------
__author__ = "ssanjay"
__version__ = "2022.10.21"
try:  # import the core honeybee dependencies
    from honeybee.typing import clean_and_id_ep_string, clean_ep_string
except ImportError as e:
    raise ImportError('\nFailed to import honeybee:\n\t{}'.format(e))

try:  # import the honeybee-energy dependencies
    from honeybee_energy.material.opaque import EnergyMaterial
except ImportError as e:
    raise ImportError('\nFailed to import honeybee_energy:\n\t{}'.format(e))

try:  # import the honeybee-energy dependencies
    from honeybee_energy.construction.opaque import OpaqueConstruction
    from honeybee_energy.lib.materials import opaque_material_by_identifier
except ImportError as e:
    raise ImportError('\nFailed to import honeybee_energy:\n\t{}'.format(e))

try:  # import ladybug_rhino dependencies
    from ladybug_rhino.grasshopper import all_required_inputs
except ImportError as e:
    raise ImportError('\nFailed to import ladybug_rhino:\n\t{}'.format(e))
import rhinoscriptsyntax as rs
import ghpythonlib.treehelpers as th
_solution = th.tree_to_list(_solution)



HB_Constructions = []

for sol in _solution:
    _materials = []
    _name_ = []
    for layer in sol:
        prop = layer.split(';')
        identifier = prop[0]
        _name = clean_ep_string(prop[1])
        _thickness = prop[2]
        _conductivity = prop[3]
        cost = prop[4]
        embodied_Carbon = prop[5]
        _density = prop[6]
        u_value = prop[7]
        # Adding default assumptions
        _roughness_ = 'MediumRough'
        _therm_absp_ = 0.9
        _sol_absp_ = 0.7
        _vis_absp_ = 0.9
        # https://www.mrsphysics.co.uk/bge/wp-content/uploads/2016/07/thermal-properties-of-building-materials.pdf
        _spec_heat = 950
        # Creating the EnergyMaterial
        mat = EnergyMaterial(
        _name,
        _thickness,
        _conductivity,
        _density,
        _spec_heat,
        _roughness_,
        _therm_absp_,
        _sol_absp_,
        _vis_absp_)
        # Add EnergyMaterial to _materials
        _materials.append(mat)
        _name_.append(_name[0:3])
    # create the construction
    material_objs = []
    for material in _materials:
        if isinstance(material, str):
            material = opaque_material_by_identifier(material)
        material_objs.append(material)
    name = '_'.join(_name_)
    constr = OpaqueConstruction(name, material_objs)
    HB_Constructions.append(constr)
# ---------- end make_hb_construction ----------
solutions = Slider(0, range=0..64800)
# TESTING!
panel_5 = Panel(itertools_2.sol_2)
panel_6 = Panel(list_comprehension_2.solution_2)
make_hb_construction_2 = GhPythonScript(solution=create_solutions.sol_combined)  # -> out, HB_Constructions; inputs solution: tree; same code as make_hb_construction
panel_7 = Panel(itertools_2.sol_4)
panel_8 = Panel(list_comprehension_2.solution_4)

# ---- group: ENERGY Properties
list_item = ListItem(List=make_hb_construction_2.HB_Constructions, Index=solutions, Wrap=True)

# ---- group: LCA/LCC Properties
construct_path = ConstructPath(Indices=["0", solutions])
tree_branch = TreeBranch(Tree=create_solutions.sol_combined, Path=construct_path, MaintainPaths=True)
getmaterialproperties = GhPythonScript(mat=tree_branch)  # -> out, identifier, Material, Thickness, Conductivity, Cost, Embodied_carbon, Density, U_value; inputs mat: list
# ---------- getmaterialproperties: Python ----------
__author__ = "ssanjay"
__version__ = "2022.10.21"

import rhinoscriptsyntax as rs
identifier = []
Material = []
Thickness = []
Conductivity = []
Cost = []
Embodied_carbon = []
Density = []
U_value = []
for material in mat:
    props = material.split(';')
    identifier.append(props[0])
    Material.append(props[1])
    Thickness.append(props[2])
    Conductivity.append(props[3])
    Cost.append(props[4])
    Embodied_carbon.append(props[5])
    Density.append(props[6])
    U_value.append(props[7])
# ---------- end getmaterialproperties ----------
panel_9 = Panel(getmaterialproperties.identifier)
panel_10 = Panel(getmaterialproperties.Material)
panel_11 = Panel(getmaterialproperties.Thickness)
panel_12 = Panel(getmaterialproperties.Conductivity)

# ----
list_item_2 = ListItem(List=make_hb_construction.HB_Constructions, Index=0, Wrap=True)
decnstrconstr = HBDeconstructConstruction(constr=list_item_2)  # -> materials, layers, r_val_si, r_val_ip, u_fac_si, u_fac_ip, t_sol, t_vis; plug-in component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
decnstrmat = HBDeconstructMaterial(mat=decnstrconstr.materials)  # -> values, attr_names, r_val_si, r_val_ip; plug-in component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
panel_13 = Panel(list_item_2)
panel_14 = Panel(decnstrmat.values)
panel_15 = Panel(decnstrmat.attr_names)
