# Grasshopper definition LB_MRT_UTCI.gh (Grasshopper 1.0.7)
# Copyright: SS
# plug-ins: Tree8

# ---- group: preparing inputs
geometry_pipeline = GeometryPipeline(
    GroupByLayer=False,
    GroupByType=False,
    IncludeHidden=True,
    IncludeLocked=True,
    LayerFilter="AnalysisPlane2",
    NameFilter="*",
    SublayerFiltering=True,
    TypeFilter=1073741848)

# ---- group: preparing inputs / obtaining points for analysis
deconstruct_brep = DeconstructBrep(Brep=geometry_pipeline)  # -> Faces, Edges, Vertices
list_item = ListItem(List=deconstruct_brep.Edges, Index=Slider(0, range=0..100), Wrap=True)
list_item_2 = ListItem(List=deconstruct_brep.Edges, Index=Slider(1, range=0..100), Wrap=True)
length = Length(Curve=list_item_2)
division = Division(A=length, B="20")
length_2 = Length(Curve=list_item)
division_2 = Division(A=length_2, B="20")
divide_domain² = DivideDomain²(Domain=geometry_pipeline, UCount=division_2, VCount=division)
isotrim = Isotrim(Surface=geometry_pipeline, Domain=divide_domain²)
area = Area(Geometry=isotrim)  # -> Area, Centroid

# ---- group: analysis for the variation with the option
geometry_pipeline_2 = GeometryPipeline(
    GroupByLayer=False,
    GroupByType=False,
    IncludeHidden=True,
    IncludeLocked=True,
    LayerFilter="CityModel Included",
    NameFilter="*",
    SublayerFiltering=True,
    TypeFilter=1073741848)
geometry_pipeline_3 = GeometryPipeline(
    GroupByLayer=False,
    GroupByType=False,
    IncludeHidden=True,
    IncludeLocked=True,
    LayerFilter="option 7",
    NameFilter="*",
    SublayerFiltering=True,
    TypeFilter=1073741848)

# ---- group: analysis for the variation with the option / INPUT
ground_reflectance = Slider(0.1, range=0..1)
wind_velocity = Panel("0.5")
runhumantosky = BooleanToggle(True)
run_utci = BooleanToggle(True)
run_mrt = BooleanToggle(True)
merge = Merge(Data1=geometry_pipeline_2, Data2=geometry_pipeline_3)
epw = FilePath("C:\Users\domin\OneDrive - Politecnico di Milano\03 chalmers\03 Job\01_assignment\SWE_Goteborg.Landvetter.025260_IWEC (1).epw")
analysis_point = Point(area.Centroid)

# ---- group: preparing inputs / INPUTS
ground_reflectance_2 = Slider(0.1, range=0..1)
geometry_pipeline_4 = GeometryPipeline(
    GroupByLayer=False,
    GroupByType=False,
    IncludeHidden=True,
    IncludeLocked=True,
    LayerFilter="CityModel Included",
    NameFilter="*",
    SublayerFiltering=True,
    TypeFilter=1073741848)
wind_velocity_2 = Panel("0.5")
runhumantosky_2 = BooleanToggle(True)
run_mrt_2 = BooleanToggle(True)
run_utci_2 = BooleanToggle(True)
analysis_point_2 = Point(area.Centroid)
epw_2 = FilePath("C:\Users\domin\OneDrive - Politecnico di Milano\03 chalmers\03 Job\01_assignment\SWE_Goteborg.Landvetter.025260_IWEC (1).epw")

# ---- group: analysis for the variation with the option / ANALYSIS
importepw = LBImportEPW(epw_file=epw)  # -> location, dry_bulb_temperature, dew_point_temperature, relative_humidity, wind_speed, wind_direction, direct_normal_rad, diffuse_horizontal_rad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; plug-in component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
solarbodypar = LBSolarBodyParameters()  # -> sol_body_par; plug-in component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
humantosky = LBHumanToSkyRelation(
    location=importepw.location,
    position=flatten(analysis_point),
    context=flatten(merge),
    parallel=Toggle(True),
    run=runhumantosky)  # -> out, human_points, human_line, fract_body_exp, sky_exposure; plug-in component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
outdoorsolarmrt = LBOutdoorSolarMRT(
    location=importepw.location,
    surface_temp=importepw.dry_bulb_temperature,
    dir_norm_rad=importepw.direct_normal_rad,
    diff_horiz_rad=importepw.diffuse_horizontal_rad,
    horiz_infrared=importepw.horizontal_infrared_rad,
    fract_body_exp=humantosky.fract_body_exp,
    sky_exposure=humantosky.sky_exposure,
    ground_ref=ground_reflectance,
    solar_body_par=solarbodypar,
    run=run_mrt)  # -> out, short_erf, long_erf, short_dmrt, long_dmrt, mrt; plug-in component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
utci = LBUTCIComfort(
    air_temp=importepw.dry_bulb_temperature,
    mrt=outdoorsolarmrt.mrt,
    rel_humid=importepw.relative_humidity,
    wind_vel=wind_velocity,
    run=run_utci)  # -> out, utci, comfort, condition, category, comf_obj; plug-in component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

# ---- group: ANALYSIS
importepw_2 = LBImportEPW(epw_file=epw_2)  # -> location, dry_bulb_temperature, dew_point_temperature, relative_humidity, wind_speed, wind_direction, direct_normal_rad, diffuse_horizontal_rad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; plug-in component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
humantosky_2 = LBHumanToSkyRelation(
    location=importepw_2.location,
    position=flatten(analysis_point_2),
    context=flatten(geometry_pipeline_4),
    parallel=Toggle(True),
    run=runhumantosky_2)  # -> out, human_points, human_line, fract_body_exp, sky_exposure; plug-in component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
solarbodypar_2 = LBSolarBodyParameters()  # -> sol_body_par; plug-in component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
outdoorsolarmrt_2 = LBOutdoorSolarMRT(
    location=importepw_2.location,
    surface_temp=importepw_2.dry_bulb_temperature,
    dir_norm_rad=importepw_2.direct_normal_rad,
    diff_horiz_rad=importepw_2.diffuse_horizontal_rad,
    horiz_infrared=importepw_2.horizontal_infrared_rad,
    fract_body_exp=humantosky_2.fract_body_exp,
    sky_exposure=humantosky_2.sky_exposure,
    ground_ref=ground_reflectance_2,
    solar_body_par=solarbodypar_2,
    run=run_mrt_2)  # -> out, short_erf, long_erf, short_dmrt, long_dmrt, mrt; plug-in component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
utci_2 = LBUTCIComfort(
    air_temp=importepw_2.dry_bulb_temperature,
    mrt=outdoorsolarmrt_2.mrt,
    rel_humid=importepw_2.relative_humidity,
    wind_vel=wind_velocity_2,
    run=run_utci_2)  # -> out, utci, comfort, condition, category, comf_obj; plug-in component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

# ---- group: calculation of coldest and warmest day of the year
number_slider = Slider(24, range=0..100)
xdata = LBDeconstructData(data=importepw_2.dry_bulb_temperature)  # -> header, values; plug-in component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
divide_domain = DivideDomain(Domain=xdata.values, Count=number_slider)
constrheader = LBConstructHeader(data_type="temperature", unit="C")  # -> header; plug-in component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
partition_list = PartitionList(List=xdata.values, Size=number_slider)
average = Average(Input=partition_list)
data = Data(flatten(average))
sort_list = SortList(Keys=data)  # -> Keys, ValuesValuesA
first_end_item = FirstEndItem(List=sort_list.Keys)  # -> FirstItem, Remainders, EndItem
smart_first_end_data = SmartFirstEndData(Tree=sort_list.Keys, Index=-1)  # -> FirstList, Remainders, EndList
item_index = ItemIndex(List=sort_list.Keys, Item=Slider(0, range=0..100))
panel = Panel(smart_first_end_data.EndList)
panel_2 = Panel(smart_first_end_data.FirstList)
member_index = MemberIndex(Set=data, Member=smart_first_end_data.FirstList)  # -> Index, Count
member_index_2 = MemberIndex(Set=data, Member=smart_first_end_data.EndList)  # -> Index, Count

# ---- group: data bump for the options
panel_3 = Panel("C:\Users\domin\OneDrive - Politecnico di Milano\03 chalmers\03 Job\02_temperature context\data results\option 3\Condition")
panel_4 = Panel("C:\Users\domin\OneDrive - Politecnico di Milano\03 chalmers\03 Job\02_temperature context\data results\option 3\UTCI")
panel_5 = Panel("C:\Users\domin\OneDrive - Politecnico di Milano\03 chalmers\03 Job\02_temperature context\data results\option 3\Comfort")
dumpdata = LBDumpData(data=flatten(utci.comfort), folder=panel_5, dump=Toggle(False))  # -> out, data_file; plug-in component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
dumpdata_2 = LBDumpData(data=flatten(utci.utci), folder=panel_4, dump=Toggle(False))  # -> out, data_file; plug-in component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
dumpdata_3 = LBDumpData(data=flatten(utci.condition), folder=panel_3, dump=Toggle(False))  # -> out, data_file; plug-in component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
panel_6 = Panel(dumpdata_3.data_file)
panel_7 = Panel(dumpdata_2.data_file)

# ---- group: calculation of coldest and warmest day of the year / warmest day of the year
# 170 day of year = 19 June
panel_8 = Panel(member_index_2.Index)

# ---- group: calculation of coldest and warmest day of the year / coldest day of the year
# 21 day of the year = 21 January
panel_9 = Panel(member_index.Index)

# ---- group: data bump base
panel_10 = Panel("C:\Users\domin\OneDrive - Politecnico di Milano\03 chalmers\03 Job\02_temperature context\data results\base\Condition")
panel_11 = Panel("C:\Users\domin\OneDrive - Politecnico di Milano\03 chalmers\03 Job\02_temperature context\data results\base\UTCI")
panel_12 = Panel("C:\Users\domin\OneDrive - Politecnico di Milano\03 chalmers\03 Job\02_temperature context\data results\base\Comfort")
dumpdata_4 = LBDumpData(data=flatten(utci_2.comfort), folder=panel_12, dump=Toggle(False))  # -> out, data_file; plug-in component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
dumpdata_5 = LBDumpData(data=flatten(utci_2.utci), folder=panel_11, dump=Toggle(False))  # -> out, data_file; plug-in component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
dumpdata_6 = LBDumpData(data=flatten(utci_2.condition), folder=panel_10, dump=Toggle(False))  # -> out, data_file; plug-in component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
panel_13 = Panel(dumpdata_6.data_file)
panel_14 = Panel(dumpdata_5.data_file)

# ----
mesh_surface = MeshSurface(Surface=geometry_pipeline, UCount=division_2, VCount=division, Overhang=True, Equalize=False)

# ---- group: legend parameters / base legend parameters
number_slider_2 = Slider(7, range=0..100)
colrange = LBColorRange(index=Slider(24, range=0..25))  # -> colors; plug-in component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
legendpar = LBLegendParameters(colors=colrange, text_height=number_slider_2)  # -> leg_par; plug-in component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

# ---- group: VISUALIZE
xdata_2 = LBDeconstructData(data=utci_2.category)  # -> header, values; plug-in component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
xheader = LBDeconstructHeader(header=xdata_2.header)  # -> data_type, unit, a_period, metadata; plug-in component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
constrheader_2 = LBConstructHeader(data_type=xheader.data_type, a_period=xheader.a_period, metadata=xheader.metadata)  # -> header; plug-in component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
data_2 = LBConstructData(header=constrheader_2, values=xdata_2.values)  # -> data; plug-in component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
hourlyplot = LBHourlyPlot(data=data_2)  # -> out, mesh, legend, borders, labels, title; plug-in component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

# ---- group: average of the whole year
xdata_3 = LBDeconstructData(data=utci_2.utci)  # -> header, values; plug-in component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
xheader_2 = LBDeconstructHeader(header=xdata_3.header)  # -> data_type, unit, a_period, metadata; plug-in component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
average_2 = Average(Input=xdata_3.values)  # -> flatten(ArithmeticMean)
constrheader_3 = LBConstructHeader(data_type=xheader_2.data_type, a_period=xheader_2.a_period, metadata=xheader_2.metadata)  # -> header; plug-in component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
heatmap = LBSpatialHeatmap(values=average_2, mesh=mesh_surface, legend_par=legendpar)  # -> mesh, legend, title, colors, legend_par; plug-in component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

# ---- group: legend parameters / coldest day legend parameters
negative = Negative(Value="0.6")
legendpar_2 = LBLegendParameters(min=negative, max="1.2", colors=colrange, text_height=number_slider_2)  # -> leg_par; plug-in component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

# ---- group: legend parameters / warmets day legend parameters
negative_2 = Negative(Value="3.2")
legendpar_3 = LBLegendParameters(min=negative_2, max=Slider(0, range=0..100), colors=colrange, text_height=number_slider_2)  # -> leg_par; plug-in component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

# ---- group: Coldest day - 21 January
number_slider_3 = Slider(21, range=0..100)
number_slider_4 = Slider(1, range=0..100)
analysisperiod = LBAnalysisPeriod(
    start_month=number_slider_4,
    start_day=number_slider_3,
    start_hour=Slider(0, range=0..100),
    end_month=number_slider_4,
    end_day=number_slider_3,
    end_hour=Slider(23, range=0..100))  # -> period, hoys, dates; plug-in component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
applyper = LBApplyAnalysisPeriod(data=utci_2.utci, period=analysisperiod.period)  # -> data; plug-in component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
xdata_4 = LBDeconstructData(data=applyper)  # -> header, values; plug-in component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
average_3 = Average(Input=xdata_4.values)  # -> flatten(ArithmeticMean)
heatmap_2 = LBSpatialHeatmap(
    values=average_3,
    mesh=mesh_surface,
    legend_par=legendpar,
    legend_title="Temperature [°C] ",
    global_title="UTCI temperature for the coldest day")  # -> mesh, legend, title, colors, legend_par; plug-in component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

# ---- group: 21 January + option
number_slider_5 = Slider(1, range=0..100)
number_slider_6 = Slider(21, range=0..100)
analysisperiod_2 = LBAnalysisPeriod(
    start_month=number_slider_5,
    start_day=number_slider_6,
    start_hour=Slider(0, range=0..100),
    end_month=number_slider_5,
    end_day=number_slider_6,
    end_hour=Slider(23, range=0..100))  # -> period, hoys, dates; plug-in component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
applyper_2 = LBApplyAnalysisPeriod(data=utci.utci, period=analysisperiod_2.period)  # -> data; plug-in component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
xdata_5 = LBDeconstructData(data=applyper_2)  # -> header, values; plug-in component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
average_4 = Average(Input=xdata_5.values)  # -> flatten(ArithmeticMean)
panel_15 = Panel("change in the UTCI temperature due to new buildings for the coldest day ")
_21_january_option = Panel("Temperature [°C] ")
subtraction = Subtraction(A=average_4, B=average_3)
heatmap_3 = LBSpatialHeatmap(values=subtraction, mesh=mesh_surface, legend_par=legendpar_2, legend_title=_21_january_option, global_title=panel_15)  # -> mesh, legend, title, colors, legend_par; plug-in component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

# ---- group: Warmest day - 19 June
number_slider_7 = Slider(6, range=0..100)
number_slider_8 = Slider(19, range=0..100)
analysisperiod_3 = LBAnalysisPeriod(
    start_month=number_slider_7,
    start_day=number_slider_8,
    start_hour=Slider(0, range=0..100),
    end_month=number_slider_7,
    end_day=number_slider_8,
    end_hour=Slider(23, range=0..100))  # -> period, hoys, dates; plug-in component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
applyper_3 = LBApplyAnalysisPeriod(data=utci_2.utci, period=analysisperiod_3.period)  # -> data; plug-in component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
xdata_6 = LBDeconstructData(data=applyper_3)  # -> header, values; plug-in component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
average_5 = Average(Input=xdata_6.values)  # -> flatten(ArithmeticMean)
heatmap_4 = LBSpatialHeatmap(
    values=average_5,
    mesh=mesh_surface,
    legend_par=legendpar,
    legend_title="Temperature [°C] ",
    global_title="UTCI temperature for the warmest day")  # -> mesh, legend, title, colors, legend_par; plug-in component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

# ---- group: 19 June + option
number_slider_9 = Slider(6, range=0..100)
number_slider_10 = Slider(19, range=0..100)
analysisperiod_4 = LBAnalysisPeriod(
    start_month=number_slider_9,
    start_day=number_slider_10,
    start_hour=Slider(0, range=0..100),
    end_month=number_slider_9,
    end_day=number_slider_10,
    end_hour=Slider(23, range=0..100))  # -> period, hoys, dates; plug-in component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
applyper_4 = LBApplyAnalysisPeriod(data=utci.utci, period=analysisperiod_4.period)  # -> data; plug-in component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
xdata_7 = LBDeconstructData(data=applyper_4)  # -> header, values; plug-in component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
average_6 = Average(Input=xdata_7.values)  # -> flatten(ArithmeticMean)
panel_16 = Panel("change in the UTCI temperature due to new buildings for the warmest day ")

# ----
subtraction_2 = Subtraction(A=average_6, B=average_5)

# ---- group: 19 June + option (continued)
heatmap_5 = LBSpatialHeatmap(values=subtraction_2, mesh=mesh_surface, legend_par=legendpar_3, legend_title=_21_january_option, global_title=panel_16)  # -> mesh, legend, title, colors, legend_par; plug-in component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
