# Grasshopper definition LB_radiation.gh (Grasshopper 1.0.7)

geometry_pipeline = GeometryPipeline(
    GroupByLayer=False,
    GroupByType=False,
    IncludeHidden=True,
    IncludeLocked=True,
    LayerFilter="CityModel Included",
    NameFilter="*",
    SublayerFiltering=True,
    TypeFilter=1073741848)
# Repeat this for all the options
geometry_pipeline_2 = GeometryPipeline(
    GroupByLayer=False,
    GroupByType=False,
    IncludeHidden=True,
    IncludeLocked=True,
    LayerFilter="option 7",
    NameFilter="*",
    SublayerFiltering=True,
    TypeFilter=1073741848)

# ---- group: Plane applied as the geometry for the analysis
geometry_pipeline_3 = GeometryPipeline(
    GroupByLayer=False,
    GroupByType=False,
    IncludeHidden=True,
    IncludeLocked=True,
    LayerFilter="AnalysisPlane",
    NameFilter="*",
    SublayerFiltering=True,
    TypeFilter=1073741848)
analysis_plane = Brep(geometry_pipeline_3)

# ----
custom_preview = CustomPreview(Geometry=geometry_pipeline, Material=ColourSwatch(SwatchColor=RGB(166, 166, 166)))
custom_preview_2 = CustomPreview(Geometry=geometry_pipeline_2, Material=ColourSwatch(SwatchColor=RGB(0, 0, 0)))

# ---- group: creating matrix containing radiation values
file_path = FilePath("C:\Users\domin\OneDrive - Politecnico di Milano\03 chalmers\03 Job\01_assignment\SWE_Goteborg.Landvetter.025260_IWEC (1).epw")
importepw = LBImportEPW(epw_file=file_path)  # -> location, dry_bulb_temperature, dew_point_temperature, relative_humidity, wind_speed, wind_direction, direct_normal_rad, diffuse_horizontal_rad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; plug-in component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
analysisperiod = LBAnalysisPeriod(start_month=1, start_day=1, start_hour=0)  # -> period, hoys, dates; plug-in component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
sunpath = LBSunPath(location=importepw.location, hoys=analysisperiod.hoys, scale=1)  # -> out, vectors, altitudes, azimuths, hoys, sun_pts, analemma, daily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; plug-in component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
skymatrix = LBCumulativeSkyMatrix(
    location=importepw.location,
    direct_rad=importepw.direct_normal_rad,
    diffuse_rad=importepw.diffuse_horizontal_rad,
    hoys=sunpath.hoys)  # -> out, sky_mtx; plug-in component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

# ---- group: combined geometry for the context impacting the analysis
combined_geometry_for_the_context_impact = Brep([geometry_pipeline, geometry_pipeline_2])  # "combined geometry for the context impacted the analysis"

# ---- group: existing context for the analysis to compare
geometry_pipeline_4 = Brep(geometry_pipeline)

# ----
number_slider = Slider(-500, range=-1000..1000)
boolean_toggle = BooleanToggle(True)
colrange = LBColorRange(index=Slider(8, range=0..25))  # -> colors; plug-in component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
legendpar = LBLegendParameters(min=Slider(-250, range=-1000..1000), max=Slider(0, range=0..1000), colors=colrange, text_height=Slider(7, range=0..10))  # -> leg_par; plug-in component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
incidentradiation = LBIncidentRadiation(
    sky_mtx=skymatrix.sky_mtx,
    geometry=flatten(analysis_plane),
    context=flatten(geometry_pipeline_4),
    grid_size="1",
    run=boolean_toggle)  # -> out, points, results, total, mesh, legend, title, int_mtx; plug-in component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
incidentradiation_2 = LBIncidentRadiation(
    sky_mtx=skymatrix.sky_mtx,
    geometry=flatten(analysis_plane),
    context=flatten(combined_geometry_for_the_context_impact),
    grid_size="1",
    run=boolean_toggle)  # -> out, points, results, total, mesh, legend, title, int_mtx; plug-in component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

# ---- group: change of cumulative indicent radation due to the addition of the new buldings
panel = Panel("kWh/m2")
panel_2 = Panel("""Change in incident radiation
due to new buildings""")
subtraction = Subtraction(A=incidentradiation_2.results, B=incidentradiation.results)
heatmap = LBSpatialHeatmap(values=subtraction, mesh=incidentradiation_2.mesh, legend_par=legendpar, legend_title=panel, global_title=panel_2)  # -> mesh, legend, title, colors, legend_par; plug-in component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

# ---- group: results of cumulative indicent radiation for the existing context
colrange_2 = LBColorRange()  # -> colors; plug-in component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
legendpar_2 = LBLegendParameters(min=Slider(0, range=0..100), max=Slider(1000, range=0..1000), colors=colrange_2, text_height=Slider(7, range=0..10))  # -> leg_par; plug-in component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
heatmap_2 = LBSpatialHeatmap(
    values=incidentradiation.results,
    mesh=incidentradiation.mesh,
    legend_par=legendpar_2,
    legend_title=panel,
    global_title="Cumulative incident radiation")  # -> mesh, legend, title, colors, legend_par; plug-in component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

# ---- group: obtaining CSV files
deconstruct = Deconstruct(Point=incidentradiation.points)  # -> XComponent, YComponent, ZComponent
deconstruct_2 = Deconstruct(Point=incidentradiation_2.points)  # -> XComponent, YComponent, ZComponent
merge = Merge(Data1="x", Data2=deconstruct.XComponent)  # -> flatten(Result)
merge_2 = Merge(Data1="y", Data2=deconstruct.YComponent)  # -> flatten(Result)
merge_3 = Merge(Data1="value", Data2=incidentradiation.results)  # -> flatten(Result)
merge_4 = Merge(Data1="x", Data2=deconstruct_2.XComponent)  # -> flatten(Result)
merge_5 = Merge(Data1="y", Data2=deconstruct_2.YComponent)  # -> flatten(Result)
merge_6 = Merge(Data1="value", Data2=incidentradiation_2.total)  # -> flatten(Result)
concatenate = Concatenate(Fragment_A=merge, Fragment_B=",", A=merge_2, B=",", C=merge_3)
concatenate_2 = Concatenate(Fragment_A=merge_4, Fragment_B=",", A=merge_5, B=",", C=merge_6)
panel_3 = Panel(concatenate)
panel_4 = Panel(concatenate_2)
