# Grasshopper definition MRT-UTCI.gh (Grasshopper 1.0.7)
# Copyright: SS

# ---- group: INPUTS
geometry_pipeline = GeometryPipeline(
    GroupByLayer=False,
    GroupByType=False,
    IncludeHidden=True,
    IncludeLocked=True,
    LayerFilter="CONTEXT",
    NameFilter="*",
    SublayerFiltering=True,
    TypeFilter=1073741848)
runhumantosky = BooleanToggle(False)
run_utci = BooleanToggle(True)
run_mrt = BooleanToggle(False)
wind_velocity = Panel("0.5")
ground_reflectance = Slider(1, range=0..1)
analysis_point = Point()
epw = FilePath()

# ---- group: ANALYSIS
importepw = LBImportEPW(epw_file=epw)  # -> location, dry_bulb_temperature, dew_point_temperature, relative_humidity, wind_speed, wind_direction, direct_normal_rad, diffuse_horizontal_rad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; plug-in component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
solarbodypar = LBSolarBodyParameters()  # -> sol_body_par; plug-in component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
humantosky = LBHumanToSkyRelation(
    location=importepw.location,
    position=flatten(analysis_point),
    context=flatten(geometry_pipeline),
    parallel=Toggle(True),
    run=runhumantosky)  # -> out, human_points, human_line, fract_body_exp, sky_exposure; plug-in component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
outdoorsolarmrt = LBOutdoorSolarMRT(
    location=importepw.location,
    surface_temp=importepw.dry_bulb_temperature,
    dir_norm_rad=importepw.direct_normal_rad,
    diff_horiz_rad=importepw.diffuse_horizontal_rad,
    horiz_infrared=importepw.horizontal_infrared_rad,
    fract_body_exp=humantosky.fract_body_exp,
    sky_exposure=humantosky.sky_exposure,
    ground_ref=ground_reflectance,
    solar_body_par=solarbodypar,
    run=run_mrt)  # -> out, short_erf, long_erf, short_dmrt, long_dmrt, mrt; plug-in component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
utci = LBUTCIComfort(
    air_temp=importepw.dry_bulb_temperature,
    mrt=outdoorsolarmrt.mrt,
    rel_humid=importepw.relative_humidity,
    wind_vel=wind_velocity,
    run=run_utci)  # -> out, utci, comfort, condition, category, comf_obj; plug-in component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

# ---- group: SUMMARISE
xdata = LBDeconstructData(data=importepw.wind_speed)  # -> header, values; plug-in component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
panel = Panel(xdata.values)
xdata_2 = LBDeconstructData(data=importepw.wind_direction)  # -> header, values; plug-in component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
panel_2 = Panel(xdata_2.values)

# ---- group: VISUALIZE
xdata_3 = LBDeconstructData(data=utci.category)  # -> header, values; plug-in component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
xheader = LBDeconstructHeader(header=xdata_3.header)  # -> data_type, unit, a_period, metadata; plug-in component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
constrheader = LBConstructHeader(data_type=xheader.data_type, a_period=xheader.a_period, metadata=xheader.metadata)  # -> header; plug-in component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
data = LBConstructData(header=constrheader, values=xdata_3.values)  # -> data; plug-in component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

# ---- group: POSTPROCESS
# -5 = Extreme Cold Stress       (UTCI < -40)
# -4 = Very Strong Cold Stress   (-40 <= UTCI < -27)
# -3 = Strong Cold Stress        (-27 <= UTCI < -13)
# -2 = Moderate Cold Stress      (-12 <= UTCI < 0)
# -1 = Slight Cold Stress        (0 <= UTCI < 9)
# 0 = No Thermal Stress         (9 <= UTCI < 26)
# +1 = Slight Heat Stress        (26 <= UTCI < 28)
# +2 = Moderate Heat Stress      (28 <= UTCI < 32)
# +3 = Strong Heat Stress        (32 <= UTCI < 38)
# +4 = Very Strong Heat Stress   (38 <= UTCI < 46)
# +5 = Extreme Heat Stress       (46 < UTCI)
panel_3 = Panel("255,255,255")
number_slider = Slider(1, range=0..25)
colrange = LBColorRange(index=Slider(15, range=0..25))  # -> colors; plug-in component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
replace_items = ReplaceItems(List=colrange, Item="255,242,204", Indices="5", Wrap=False)
legendpar = LBLegendParameters(colors=replace_items, font="Arial")  # -> leg_par; plug-in component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
panel_4 = Panel("""-5 = Extreme Cold Stress       (UTCI < -40)
-4 = Very Strong Cold Stress   (-40 <= UTCI < -27)
-3 = Strong Cold Stress        (-27 <= UTCI < -13)
-2 = Moderate Cold Stress      (-12 <= UTCI < 0)
-1 = Slight Cold Stress        (0 <= UTCI < 9)
0 = No Thermal Stress         (9 <= UTCI < 26)
+1 = Slight Heat Stress        (26 <= UTCI < 28)
+2 = Moderate Heat Stress      (28 <= UTCI < 32)
+3 = Strong Heat Stress        (32 <= UTCI < 38)
+4 = Very Strong Heat Stress   (38 <= UTCI < 46)
+5 = Extreme Heat Stress       (46 < UTCI)""")
panel_5 = Panel("255,255,255")
number_slider_2 = Slider(1, range=0..25)
colrange_2 = LBColorRange(index=Slider(15, range=0..25))  # -> colors; plug-in component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
replace_items_2 = ReplaceItems(List=colrange_2, Item="255,242,204", Indices="5", Wrap=False)
panel_6 = Panel("""5,48,97
33,102,172
67,147,195
146,197,222
209,229,240
255,255,255
253,219,199
244,165,130
214,96,77
178,24,43
103,0,31""")
legendpar_2 = LBLegendParameters(max="8", colors=replace_items_2, font="Arial")  # -> leg_par; plug-in component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
panel_7 = Panel("""053061
2166AC
4393C3
92C5DE
D1E5F0
FFFFFF
FDDBC7
F4A582
D6604D
B2182B
67001F""")
legend = Legend(Colour=replace_items, Tags=panel_4, LegendType=1)

# ---- group: VISUALIZE (continued)
hourlyplot = LBHourlyPlot(data=data, legend_par=legendpar)  # -> out, mesh, legend, borders, labels, title; plug-in component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

# ---- group: POSTPROCESS / Autumn
analysisperiod = LBAnalysisPeriod(start_month="10", start_day=1, start_hour=0, end_month="12", end_day="31", end_hour="23")  # -> period, hoys, dates; plug-in component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
applyper = LBApplyAnalysisPeriod(data=utci.category, period=analysisperiod.period)  # -> data; plug-in component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
list_length = ListLength(List=analysisperiod.hoys)
xdata_4 = LBDeconstructData(data=applyper)  # -> header, values; plug-in component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
create_set = CreateSet(List=xdata_4.values)  # -> Set, Map
integer = Integer([-5, -4, -3, -2, -1, 0, 1, 2, 3, 4, 5])
member_index = MemberIndex(Set=flatten(xdata_4.values), Member=integer)  # -> Index, Count

# ---- group: POSTPROCESS / Spring
analysisperiod_2 = LBAnalysisPeriod(start_month="4", start_day=1, start_hour=0, end_month="6", end_day="31", end_hour="23")  # -> period, hoys, dates; plug-in component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
applyper_2 = LBApplyAnalysisPeriod(data=utci.category, period=analysisperiod_2.period)  # -> data; plug-in component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
list_length_2 = ListLength(List=analysisperiod_2.hoys)
xdata_5 = LBDeconstructData(data=applyper_2)  # -> header, values; plug-in component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
create_set_2 = CreateSet(List=xdata_5.values)  # -> Set, Map
integer_2 = Integer([-5, -4, -3, -2, -1, 0, 1, 2, 3, 4, 5])
member_index_2 = MemberIndex(Set=flatten(xdata_5.values), Member=integer_2)  # -> Index, Count

# ---- group: POSTPROCESS / Summer
analysisperiod_3 = LBAnalysisPeriod(start_month="7", start_day=1, start_hour=0, end_month="9", end_day="31", end_hour="23")  # -> period, hoys, dates; plug-in component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
applyper_3 = LBApplyAnalysisPeriod(data=utci.category, period=analysisperiod_3.period)  # -> data; plug-in component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
list_length_3 = ListLength(List=analysisperiod_3.hoys)
xdata_6 = LBDeconstructData(data=applyper_3)  # -> header, values; plug-in component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
create_set_3 = CreateSet(List=xdata_6.values)  # -> Set, Map
integer_3 = Integer([-5, -4, -3, -2, -1, 0, 1, 2, 3, 4, 5])
member_index_3 = MemberIndex(Set=flatten(xdata_6.values), Member=integer_3)  # -> Index, Count

# ---- group: POSTPROCESS / Winter
analysisperiod_4 = LBAnalysisPeriod(start_month="1", start_day=1, start_hour=0, end_month="3", end_day="31", end_hour="23")  # -> period, hoys, dates; plug-in component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
applyper_4 = LBApplyAnalysisPeriod(data=utci.category, period=analysisperiod_4.period)  # -> data; plug-in component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
list_length_4 = ListLength(List=analysisperiod_4.hoys)
xdata_7 = LBDeconstructData(data=applyper_4)  # -> header, values; plug-in component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
create_set_4 = CreateSet(List=xdata_7.values)  # -> Set, Map
integer_4 = Integer([-5, -4, -3, -2, -1, 0, 1, 2, 3, 4, 5])
member_index_4 = MemberIndex(Set=flatten(xdata_7.values), Member=integer_4)  # -> Index, Count

# ---- group: POSTPROCESS (continued)
comfort_index = Panel(integer)
comfort_index_2 = Panel(integer_2)
comfort_index_3 = Panel(integer_3)
comfort_index_4 = Panel(integer_4)
hours = Panel(member_index.Count)
hours_2 = Panel(member_index_2.Count)
hours_3 = Panel(member_index_3.Count)
hours_4 = Panel(member_index_4.Count)
windrose = LBWindRose(
    data=importepw.wind_speed,
    wind_direction=importepw.wind_direction,
    legend_par=legendpar_2,
    period=analysisperiod_4.period)  # -> out, mesh, compass, orient_line, freq_line, windrose_line, legend, title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; plug-in component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
windrose_2 = LBWindRose(data=importepw.wind_speed, wind_direction=importepw.wind_direction, legend_par=legendpar_2, period=analysisperiod.period)  # -> out, mesh, compass, orient_line, freq_line, windrose_line, legend, title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; plug-in component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
windrose_3 = LBWindRose(
    data=importepw.wind_speed,
    wind_direction=importepw.wind_direction,
    legend_par=legendpar_2,
    period=analysisperiod_2.period)  # -> out, mesh, compass, orient_line, freq_line, windrose_line, legend, title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; plug-in component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
windrose_4 = LBWindRose(
    data=importepw.wind_speed,
    wind_direction=importepw.wind_direction,
    legend_par=legendpar_2,
    period=analysisperiod_3.period)  # -> out, mesh, compass, orient_line, freq_line, windrose_line, legend, title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; plug-in component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
panel_8 = Panel(windrose_3.prevailing)
panel_9 = Panel(windrose_2.prevailing)
panel_10 = Panel(windrose.prevailing)
panel_11 = Panel(windrose_4.prevailing)

# ---- group: POSTPROCESS / Autumn (continued)
expression = Expression(x=hours, y=list_length, Expression="(x/y)*100")

# ---- group: POSTPROCESS / Spring (continued)
expression_2 = Expression(x=hours_2, y=list_length_2, Expression="(x/y)*100")

# ---- group: POSTPROCESS / Summer (continued)
expression_3 = Expression(x=hours_3, y=list_length_3, Expression="(x/y)*100")

# ---- group: POSTPROCESS / Winter (continued)
expression_4 = Expression(x=hours_4, y=list_length_4, Expression="(x/y)")

# ---- group: POSTPROCESS (continued)
percentage_of_time = Panel(expression)
percentage_of_time_2 = Panel(expression_2)
percentage_of_time_3 = Panel(expression_4)
percentage_of_time_4 = Panel(expression_3)
