# Grasshopper definition DF_HB_v2.gh (Grasshopper 1.0.7)
# plug-ins: LadybugGrasshopper, Pufferfish

# ---- group: MAIN CONTROLS FOR THE SCRIPT
# Valid options to choose from: option 1
# option 2
# option 3
# option 4
# option 5
# option 6
# option 7
include_study_buildings = BooleanToggle(False)
use_multipier_for_the_honeybee_model = BooleanToggle(False)
create_the_honeybee_model = LBFalseStartToggle(True)
show_honeybee_model_in_rhino = BooleanToggle(True)
list = ValueList({"Select an option for RUN": 0, "3 - Run EnergyPlus Simulation": 1, "3 - Only create IDF": 2}, selected="3 - Only create IDF")
file_path = FilePath("D:\Backup\Year1\WIP\Slingshot\data\SWE_Goteborg.Landvetter.025260_IWEC.epw")
select_a_epw_file = Panel(file_path)

# ----
geometry_pipeline = GeometryPipeline(
    GroupByLayer=False,
    GroupByType=False,
    IncludeHidden=True,
    IncludeLocked=True,
    LayerFilter="surrounding_buildings",
    NameFilter="*",
    SublayerFiltering=True,
    TypeFilter=1073741848)
ghpython_script = GhPythonScript(CityModel="D:\GitHub\dtcc\data\uddevala\city.json", cull_area="<150", run=Toggle(False))  # -> out, footprints, heights, buildings, culled_buildings, origin
# ---------- ghpython_script: Python ----------
import Rhino
import Rhino.Geometry as rg
import json
import ghpythonlib.treehelpers as th
def should_cull(value, criterion):
    """
    Determine if a value should be culled based on the criterion.
    criterion: string in format '>100' or '<100'
    """
    if not criterion:
        return False
    operation = criterion[0]
    threshold = float(criterion[1:])
    if operation == '>':
        return value > threshold
    elif operation == '<':
        return value < threshold
    return False
if _run:
    with open(CityModel, 'r') as file:
        data = json.load(file)

    # Extract bounds
    xmin = data['bounds']['xmin']
    ymin = data['bounds']['ymin']

    footprints = []
    heights = []
    buildings = []
    culled_buildings = []
    # Loop through buildings in the data
    for building in data['buildings']:
        points = []

        z = building['groundHeight']
        
        height = building['height']

        # Extract footprint points and subtract xmin and ymin from x and y respectively
        for vertex in building['footprint']['shell']['vertices']:
            x = vertex['x'] - xmin
            y = vertex['y'] - ymin
            points.append(rg.Point3d(x, y, z))


        # Create the building in Rhino
        polyline = rg.PolylineCurve(points)

        # Ensure the polyline is closed
        if not polyline.IsClosed:
            polyline.MakeClosed(0.01)  # 0.01 is a small tolerance value
        footprints.append(polyline)
        vector = rg.Vector3d(0, 0, height)
        extrusion = rg.Extrusion.Create(polyline, height, True)

        if extrusion:
            brep = extrusion.ToBrep()
            area = rg.AreaMassProperties.Compute(brep).Area
            volume = rg.VolumeMassProperties.Compute(brep).Volume
            # Append the building and its details to their respective lists
            footprints.append(polyline)
            heights.append(height)
        if (should_cull(area, cull_area) or 
            should_cull(volume, cull_volume) or 
            should_cull(height, cull_height)):
            culled_buildings.append(brep)
        else:
            buildings.append(brep)
    origin = rg.Point3d(xmin, ymin, 0)
# ---------- end ghpython_script ----------

# ---- group: MAIN CONTROLS FOR THE SCRIPT / geometry of a new object / building
geometry_pipeline_2 = GeometryPipeline(
    GroupByLayer=False,
    GroupByType=False,
    IncludeHidden=True,
    IncludeLocked=True,
    LayerFilter="option 4",
    NameFilter="*",
    SublayerFiltering=True,
    TypeFilter=1073741848)

# ----
geometry_pipeline_3 = GeometryPipeline(
    GroupByLayer=False,
    GroupByType=False,
    IncludeHidden=True,
    IncludeLocked=True,
    LayerFilter="*",
    NameFilter="*",
    SublayerFiltering=True,
    TypeFilter=32)
brep = Brep(ghpython_script.culled_buildings)
brep_2 = Brep(ghpython_script.buildings)
point = Point(Point(0, 0, 0))
vector_2pt = Vector2Pt(PointA=ghpython_script.origin, PointB=point, Unitize=False)  # -> Vector, Length
move = Move(Geometry=geometry_pipeline_3, Motion=vector_2pt.Vector)  # -> Geometry, Transform
list_item = ListItem(List=move.Geometry, Index=0, Wrap=True)
deconstruct_mesh = DeconstructMesh(Mesh=list_item)  # -> Vertices, Faces, Colours, Normals
deconstruct = Deconstruct(Point=deconstruct_mesh.Vertices)  # -> XComponent, YComponent, ZComponent
highest_lowest_numbers = HighestLowestNumbers(Numbers=deconstruct.ZComponent)  # -> Highest, Lowest
gradient = Gradient(
    LowerLimit=highest_lowest_numbers.Lowest,
    UpperLimit=highest_lowest_numbers.Highest,
    Parameter=deconstruct.ZComponent,
    stops=[0: RGB(255, 255, 216), 0.0312: RGB(250, 253, 206), 0.0625: RGB(245, 251, 196), 0.0938: RGB(241, 249, 186), 0.125: RGB(236, 247, 177), 0.156: RGB(227, 244, 177)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])
mesh_colours = MeshColours(Mesh=list_item, Colours=gradient)  # disabled

# ---- group: DF model
# creates DF model with the new building/s treated as a context to check the impact on existing surrounding
hb_building_programs = HBBuildingPrograms({"LargeOffice", "MediumOffice", "SmallOffice", "MidriseApartment", "HighriseApartment", "Retail", "StripMall", "PrimarySchool", "SecondarySchool", "SmallHotel", "LargeHotel", "Hospital", "Outpatient", "Laboratory", "Warehouse", "SuperMarket", "FullServiceRestaurant", "QuickServiceRestaurant", "Courthouse", "LargeDataCenterHighITE", "LargeDataCenterLowITE", "SmallDataCenterHighITE", "SmallDataCenterLowITE"}, selected="MediumOffice")
hb_climate_zones = HBClimateZones({"1 - Very Hot": "1", "2 - Hot": "2", "3 - Warm": "3", "4 - Mixed": "4", "5 - Cool": "5", "6 - Cold": "6", "7 - Very Cold": "7", "8 - Subarctic": "8"}, selected="5 - Cool")
constrsetclimate = HBConstructionSetByClimate(climate_zone=hb_climate_zones)  # -> constr_set; plug-in component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
buildingsolid = DFBuildingFromSolid(
    bldg_geo=flatten(geometry_pipeline),
    floor_to_floor="@3",
    perim_offset="0",
    name="surrounding - office",
    program=hb_building_programs,
    constr_set=constrsetclimate,
    conditioned=Toggle(True),
    run=create_the_honeybee_model)  # -> out, buildings; plug-in component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
context = DFContextShade(geo=geometry_pipeline_2)  # -> out, context; plug-in component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

# ----
filter = StreamFilter(Gate=include_study_buildings, Stream1=context.context)

# ---- group: DF model (continued)
model = DFModel(buildings=flatten(buildingsolid.buildings), context=flatten(filter), name="simulation 1")  # -> out, model; plug-in component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

# ---- group: applying windows on the elevations
repeatingratiopar = DFRepeatingWindowRatioParameters(ratio=Slider(0.3, range=0.1..1), win_height=Slider(1.7, range=1..4), horiz_separ=Slider(4, range=1..4))  # -> win_par; plug-in component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
applyfacadepar = DFApplyFacadeParameters(df_obj=flatten(model.model), win_par=repeatingratiopar)  # -> out, df_obj; plug-in component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

# ---- group: translation to the HB model
tohoneybee = DFModelToHoneybee(
    model=applyfacadepar.df_obj,
    obj_per_model="district",
    use_multiplier=use_multipier_for_the_honeybee_model,
    run=create_the_honeybee_model)  # -> out, hb_models; plug-in component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
idealair = HBIdealAir(rooms=flatten(tohoneybee.hb_models))  # -> report, rooms; plug-in component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
model_2 = HBModel(rooms=flatten(idealair.rooms))  # -> out, model; plug-in component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

# ----
filter_2 = StreamFilter(Gate=show_honeybee_model_in_rhino, Stream1=model_2.model)
afn = HBAirflowNewtwork(model=model_2.model, leakage_template="Medium", high_rise=Toggle(False))  # -> report, model; plug-in component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

# ---- group: OSM model for the energy results
modeltoosm = HBModelToOSM(model=afn.model, epw_file=file_path, write=Toggle(True), run=list)  # -> out, jsons, osw, osm, idf, sql, zsz, rdd, html; plug-in component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
roomenergyresult = HBReadRoomEnergyResult(sql=modeltoosm.sql)  # -> cooling, heating, lighting, electric_equip, gas_equip, process, hot_water, fan_electric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; plug-in component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

# ---- group: visualisation of HB model
vizbytype = HBVisualizeByType(hb_objs=filter_2)  # -> walls, interior_walls, roofs, ceilings, exterior_floors, interior_floors, air_walls, apertures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; plug-in component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

# ----
panel = Panel(modeltoosm.idf)
merge = Merge(
    Data1=vizbytype.walls,
    Data2=vizbytype.interior_walls,
    Data3=vizbytype.roofs,
    Data4=vizbytype.ceilings,
    Data5=vizbytype.exterior_floors,
    Data6=vizbytype.interior_floors,
    Data7=vizbytype.air_walls,
    Data8=vizbytype.apertures,
    Data9=vizbytype.interior_apertures,
    Data10=vizbytype.doors,
    Data11=vizbytype.interior_doors,
    Data12=vizbytype.outdoor_shades,
    Data13=vizbytype.indoor_shades,
    Data14=vizbytype.wire_frame)
mesh = Mesh(merge)

# ---- group: visualisation of the energy results
labelrooms = HBLabelRooms(rooms_model=flatten(model_2.model), txt_height=Slider(3, range=0..10))  # -> label_text, base_pts, labels, wire_frame; plug-in component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
legendpar = LBLegendParameters(min=Slider(10, range=0..10), max=Slider(90, range=0..100), text_height=Slider(10, range=0..10))  # -> leg_par; plug-in component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
colorrooms = HBColorRooms(data=flatten(roomenergyresult.heating), rooms_model=flatten(model_2.model), legend_par=legendpar)  # -> readMe, mesh, wire_frame, legend, title, rooms, colors, values; plug-in component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
